# Grasshopper definition GridStructure.gh (Grasshopper 0.9.76)
# plug-ins: Karamba, Python Interpreter, LunchBoxML, Kangaroo Components, PTComponentLibrary, FlexHopper, LunchBox, Weaverbird

number_slider = Slider(0.063, range=0..1)  # disabled
number_slider_2 = Slider(0.525, range=0..1)  # disabled
construct_domain = ConstructDomain(DomainStart=expr("-x", number_slider), DomainEnd=number_slider)  # disabled
construct_domain_2 = ConstructDomain(DomainStart=expr("-x", number_slider_2), DomainEnd=number_slider_2)  # disabled
construct_point = ConstructPoint(XCoordinate=0, YCoordinate=0, ZCoordinate=0)  # disabled
number_slider_3 = Slider(5, range=0..10)  # disabled
ladybug = Ladybug_Ladybug()  # -> out; plug-in component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
number_slider_4 = Slider(0.6, range=0..3)  # disabled
number_slider_5 = Slider(10, range=0..10)  # disabled
number_slider_6 = Slider(0.025, range=0..10)  # disabled
rectangle = Rectangle(Plane=construct_point, XSize=construct_domain, YSize=construct_domain_2, Radius=0)  # -> Rectangle, Length; disabled
unit_z = UnitZ(Factor=number_slider_4)  # disabled
number_slider_7 = Slider(1, range=0..10)  # disabled
boolean_toggle = BooleanToggle(True)  # disabled
extrude = Extrude(Base=rectangle.Rectangle, Direction=unit_z)  # disabled
boolean_toggle_2 = BooleanToggle(True)  # disabled
c_script = CSharpScript(x=number_slider_5, y=number_slider_5, z=number_slider_6)  # -> out, A; inputs x: Int32, y: Int32, z: Double; disabled
# ---------- c_script: C# ----------
    var points = new DataTree<Point3d>();

    for(int i = 1; i <= x; ++i)
      for(int j = 1; j <= y; ++j)
      {

        points.Add(new Point3d(i, j, z * ( -( i * j ) )), new GH_Path(i));

      }

    A = points;
# ---------- end c_script ----------
flip_matrix = FlipMatrix(Data=c_script.A)  # disabled
polyline = PolyLine(Vertices=flip_matrix, Closed=False)  # -> flatten(Polyline); disabled
dispatch = Dispatch(List=polyline, DispatchPattern=[True, False])  # -> ListA, ListB; disabled
curve = Curve(dispatch.ListB)  # disabled
curve_2 = Curve(dispatch.ListA)  # disabled
divide_curve = DivideCurve(Curve=curve, Count=number_slider_3, Kinks=False)  # -> Points, Tangents, Parameters; disabled
divide_curve_2 = DivideCurve(Curve=curve_2, Count=10, Kinks=False)  # -> Points, Tangents, Parameters; disabled
list_item = ListItem(List=flatten(c_script.A), Index=number_slider_7, Wrap=True)  # disabled
cull_pattern = CullPattern(List=c_script.A, CullPattern=invert([True, False]))  # disabled
cull_pattern_2 = CullPattern(List=c_script.A, CullPattern=[True, False])  # disabled
cap_holes = CapHoles(Brep=extrude)  # disabled
open_weather_file = Ladybug_OpenEPWWeatherFile(open=boolean_toggle_2)  # -> epwFile; disabled; plug-in component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
gencumulativeskymtx = Ladybug_GenCumulativeSkyMtx(epwFile=open_weather_file, skyDensity=0, useOldRes=True, runIt=boolean_toggle)  # -> out, cumulativeSkyMtx; disabled; plug-in component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
panel = Panel("{+1}")  # disabled
panel_2 = Panel("{+1}")  # disabled
importepw = Ladybug_ImportEpw(epwFile=open_weather_file)  # -> Output, latitude, location, dryBulbTemperature, dewPointTemperature, relativeHumidity, windSpeed, windDirection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; disabled; plug-in component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
list_item_2 = ListItem(List=flatten(c_script.A), Index=0, Wrap=True)  # disabled
selectskymtx = Ladybug_selectSkyMtx(cumulativeSkyMtx=gencumulativeskymtx.cumulativeSkyMtx, removeDiffuse=False, removeDirect=False)  # -> out, selectedSkyMtx; disabled; plug-in component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
relative_item = RelativeItem(Tree=cull_pattern, Offset=panel, WrapPaths=False, WrapItems=False)  # -> ItemA, ItemB; disabled
relative_item_2 = RelativeItem(Tree=cull_pattern_2, Offset=panel_2, WrapPaths=False, WrapItems=False)  # -> ItemA, ItemB; disabled
vector_2pt = Vector2Pt(PointA=construct_point, PointB=list_item_2, Unitize=False)  # -> Vector, Length; disabled
vector_2pt_2 = Vector2Pt(PointA=construct_point, PointB=list_item, Unitize=False)  # -> Vector, Length; disabled
point = Point(relative_item.ItemB)  # disabled
flip_matrix_2 = FlipMatrix(Data=point)  # disabled
polyline_2 = PolyLine(Vertices=flip_matrix_2, Closed=False)  # -> flatten(Polyline); disabled
list_length = ListLength(List=polyline_2)  # disabled
point_2 = Point(relative_item_2.ItemA)  # disabled
move = Move(Geometry=cap_holes, Motion=vector_2pt.Vector)  # -> Geometry, Transform; disabled
move_2 = Move(Geometry=cap_holes, Motion=vector_2pt_2.Vector)  # -> Geometry, Transform; disabled
boolean_toggle_3 = BooleanToggle(True)  # disabled
radiationrose = Ladybug_RadiationRose(selectedSkyMtx=selectskymtx.selectedSkyMtx, arrowHeadScale=1, runIt=boolean_toggle)  # -> out, radiationArrowsMesh, radRoseBaseCrvs, legend, legendBasePts, radRoseEndPts, radRoseValues; disabled; plug-in component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
perp_frames = PerpFrames(Curve=polyline_2, Count=list_length, Align=False)  # -> Frames, Parameters; disabled
windrose = Ladybug_WindRose(north=0, hourlyWindDirection=importepw.windDirection, hourlyWindSpeed=importepw.windSpeed, runIt=boolean_toggle_3)  # -> out, calmRoseMesh, windRoseMesh, windRoseCrvs, windRoseCenPts, legend, legendBasePts, title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; disabled; plug-in component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
flip_matrix_3 = FlipMatrix(Data=point_2)  # disabled
polyline_3 = PolyLine(Vertices=flip_matrix_3, Closed=False)  # -> flatten(Polyline); disabled
list_length_2 = ListLength(List=polyline_3)  # disabled
perp_frames_2 = PerpFrames(Curve=polyline_3, Count=list_length_2, Align=False)  # -> Frames, Parameters; disabled
number_slider_8 = Slider(5, range=-1..10)  # disabled
number_slider_9 = Slider(10, range=0..10)  # disabled
number_slider_10 = Slider(-1, range=-1..10)  # disabled
number_slider_11 = Slider(5, range=0..10)  # disabled
number_slider_12 = Slider(1, range=0..1)  # disabled
number_slider_13 = Slider(0, range=0..10)  # disabled
construct_domain_3 = ConstructDomain(DomainStart=number_slider_8, DomainEnd=number_slider_9)  # disabled
number_slider_14 = Slider(1, range=0..10)  # disabled
construct_domain_4 = ConstructDomain(DomainStart=number_slider_10, DomainEnd=number_slider_11)  # disabled
orient = Orient(Geometry=move.Geometry, Source=list_item_2, Target=perp_frames_2.Frames)  # -> Geometry, Transform; disabled
orient_2 = Orient(Geometry=move_2.Geometry, Source=list_item, Target=perp_frames.Frames)  # -> Geometry, Transform; disabled
construct_path = ConstructPath(Indices=number_slider_12)  # disabled
number_slider_15 = Slider(1000, range=0..1000)  # disabled
number_slider_16 = Slider(562, range=0..1000)  # disabled
number_slider_17 = Slider(-1, range=-1..10)  # disabled
number_slider_18 = Slider(0, range=0..10)  # disabled
panel_3 = Panel(windrose.averageVelocities)  # disabled
tree_branch = TreeBranch(Tree=radiationrose.radiationArrowsMesh, Path=construct_path, MaintainPaths=True)  # disabled

# ---- group: XAndYSize
number_slider_19 = Slider(3, range=0..10)  # disabled
number_slider_20 = Slider(7, range=0..10)  # disabled
division = Division(A=number_slider_20, B=number_slider_19)  # disabled

# ----
number_slider_21 = Slider(35, range=0..100)  # disabled
construct_domain_5 = ConstructDomain(DomainStart=number_slider_13, DomainEnd=number_slider_14)  # disabled
construct_domain_6 = ConstructDomain(DomainStart=number_slider_17, DomainEnd=number_slider_18)  # disabled

# ---- group: OverLapRain
number_slider_22 = Slider(0.946643, range=0..1)  # disabled
multiplication = Multiplication(A=division, B=number_slider_22)  # disabled

# ----
number_slider_23 = Slider(1.542, range=0..10)  # disabled
number_slider_24 = Slider(4.177, range=0..10)  # disabled
number_slider_25 = Slider(2.898, range=0..10)  # disabled
number_slider_26 = Slider(6.592, range=0..10)  # disabled
number_slider_27 = Slider(4.988, range=0..10)  # disabled
number_slider_28 = Slider(2.506, range=0..10)  # disabled

# ---- group: GetFixedAreaWhenApplyingOverlap
multiplication_2 = Multiplication(A=multiplication, B=number_slider_19)  # disabled
subtraction = Subtraction(A=number_slider_20, B=multiplication_2)  # disabled
addition = Addition(A=multiplication, B=subtraction)  # disabled

# ----
c_script_2 = CSharpScript(x=windrose.averageVelocities)  # -> out, A; inputs x: list of Double; disabled
# ---------- c_script_2: C# ----------
    var points = new List<Point3d>();
    
    for(int i = 1; i < 15; ++i)
      for(int j = 1; j < 15; ++j)
      {
      
        points.Add(new Point3d( i, j, x[i] * 5.0 ));
      
      }
    
    A = points;
# ---------- end c_script_2 ----------
number_slider_29 = Slider(1000, range=0..1000)  # disabled
number_slider_30 = Slider(1, range=0..10)  # disabled
c_script_3 = CSharpScript()  # -> out, A; disabled
# ---------- c_script_3: C# ----------
    var points = new Point3d[10,10];
    
    for(int i = 0; i < 10; ++i)
      for(int j = 0; j < 10; ++j)
      {
      
        points[i, j] = new Point3d( i, j, 0 );
      
      }
    
    A = points;
# ---------- end c_script_3 ----------
list_length_3 = ListLength(List=c_script_3.A)  # disabled
list_length_4 = ListLength(List=c_script_3.A)  # disabled
square_root = SquareRoot(Value=list_length_3)  # disabled
square_root_2 = SquareRoot(Value=list_length_4)  # disabled
series = Series(Start=0, Step=1, Count=square_root)  # disabled
random = Random(Range=construct_domain_3, Number=square_root, Seed=number_slider_15)  # disabled
series_2 = Series(Start=0, Step=1, Count=square_root_2)  # disabled
random_2 = Random(Range=construct_domain_4, Number=square_root_2, Seed=number_slider_16)  # disabled
number_slider_31 = Slider(10, range=0..10)  # disabled
construct_point_2 = ConstructPoint(XCoordinate=series, YCoordinate=random, ZCoordinate=0)  # disabled
construct_point_3 = ConstructPoint(XCoordinate=series_2, YCoordinate=random_2, ZCoordinate=0)  # disabled
range = Range(Domain=construct_domain_5, Steps=number_slider_21)  # disabled
number_slider_32 = Slider(14, range=0..100)  # disabled
random_3 = Random(Range=construct_domain_6, Number=expr("x+1", number_slider_21), Seed=number_slider_29)  # disabled
panel_4 = Panel("-3.5 To 3.5")  # disabled
construct_point_4 = ConstructPoint(XCoordinate=0, YCoordinate=0, ZCoordinate=0)  # disabled
c_script_4 = CSharpScript(DeformationX=number_slider_27, DeformationY=number_slider_28)  # -> out, A, B, C; inputs DeformationX: Double, DeformationY: Double; disabled
# ---------- c_script_4: C# ----------
    /*
    var points = new List<Point3d>();

    for( int i = 0; i < NumberOfPoints; ++i )
    {

      points.Add(new Point3d(DeformationX * Math.Cos(i), DeformationY * Math.Sin(i), 0));

    }
    */

    var plane = new Plane(new Point3d(0, 0, 0), Vector3d.ZAxis);
    var planeOne = new Plane(new Point3d(-DeformationX, -DeformationY, 0), Vector3d.ZAxis);
    
    //var plane

    var bouRect = new Rhino.Geometry.Rectangle3d(planeOne, DeformationX * 2, DeformationY * 2);

    var ellipse = new Rhino.Geometry.Ellipse(plane, DeformationX, DeformationY);
    
    var ellipseO = new Rhino.Geometry.Ellipse( Plane.WorldZX, DeformationY, DeformationX );

    var bouRectArea = AreaMassProperties.Compute(bouRect.ToNurbsCurve()).Area;

    A = bouRect;
    B = ellipse;
    C = ellipseO;
    
    //var sph = new Rhino.Geometry.Sphere(
# ---------- end c_script_4 ----------
c_script_5 = CSharpScript(DeformationX=number_slider_23, DeformationY=number_slider_24, DeformationZ=number_slider_25, x=number_slider_26)  # -> out, A, B, C; inputs DeformationX: Double, DeformationY: Double, DeformationZ: Double, x: Double; disabled
# ---------- c_script_5: C# ----------
    var point = new Point3d(0, 0, 0);
    var plane = new Plane(point, Vector3d.ZAxis);
    var planeOne = new Plane(new Point3d(-DeformationX, -DeformationY, 0), Vector3d.ZAxis);

    var bouRect = new Rhino.Geometry.Rectangle3d(planeOne, DeformationX * 2, DeformationY * 2);
    var bouRectArea = AreaMassProperties.Compute(bouRect.ToNurbsCurve()).Area;

    var sphe = new Rhino.Geometry.Sphere(new Point3d(0, 0, 0), 1.0).ToNurbsSurface();
    var scal = Transform.Scale(plane, DeformationX, DeformationY, DeformationZ);
    sphe.Transform(scal);
    var rot = Transform.Rotation(Math.Sin(x), Math.Cos(x), Vector3d.YAxis, point);
    sphe.Transform(rot);
    var spheBrep = sphe.ToBrep();

    //A = bouRect;

    var bbox = spheBrep.GetBoundingBox(plane).ToBrep();

    var bboxCurves = Rhino.Geometry.Brep.CreateContourCurves(bbox, plane);
    
    var box = Extrusion.Create(bboxCurves[0].ToNurbsCurve(), -DeformationZ, true).ToBrep();
    
    var brepList = new List<Brep>();
    brepList.Add(spheBrep);
    brepList.Add(box);
    var boolDiff = Brep.CreateBooleanDifference(brepList[0], brepList[1], 0.0001)[0];
    
    A = boolDiff;
    
    //B = spheBrep;

    point.Transform(Transform.Translation(new Vector3d(new Point3d(0, 0, 5) - point)));

    C = point;
# ---------- end c_script_5 ----------
series_3 = Series(Start=0, Step=1, Count=number_slider_30)  # disabled
graph_mapper = GraphMapper(range, x0=0, x1=1, y0=0, y1=1, container_name="Gaussian", factor=0.3030704856, mean=0.5056756735, sdev=0.09340542555)  # disabled
unit_z_2 = UnitZ(Factor=1)  # disabled
polyline_4 = PolyLine(Vertices=construct_point_3, Closed=False)  # disabled
polyline_5 = PolyLine(Vertices=construct_point_2, Closed=False)  # disabled
unit_y = UnitY(Factor=number_slider_31)  # disabled
rectangle_2 = Rectangle(Plane=PlaneXY(0, 0, 0), XSize=panel_4, YSize=panel_4, Radius=0)  # -> Rectangle, Length; disabled
rectangle_3 = Rectangle(Plane=PlaneXY(0, 0, 0), XSize=number_slider_20, YSize=addition, Radius=0)  # -> Rectangle, Length; disabled
deconstruct = Deconstruct(Point=construct_point_3)  # -> XComponent, YComponent, ZComponent; disabled
surface_from_points = SurfaceFromPoints(Points=c_script_2.A, UCount=number_slider_32, Interpolate=False)  # disabled
list_length_5 = ListLength(List=deconstruct.YComponent)  # disabled
panel_5 = Panel(c_script_4.C)  # disabled
curve_3 = Curve(c_script_4.A)  # disabled
curve_4 = Curve(c_script_4.B)  # disabled
curve_5 = Curve(c_script_4.C)  # disabled
number_slider_33 = Slider(123, range=0..1000)  # disabled
contour = Contour(Shape=c_script_5.A, Point=Point(0, 0, 0), Direction=unit_z_2, Distance=number_slider_25)  # disabled

# ---- group: Logic
unit_y_2 = UnitY(Factor=multiplication)  # disabled
move_3 = Move(Geometry=rectangle_3.Rectangle, Motion=unit_y_2)  # -> Geometry, Transform; disabled
discontinuity = Discontinuity(Curve=move_3.Geometry, Level=1)  # -> Points, Parameters; disabled
deconstruct_2 = Deconstruct(Point=discontinuity.Points)  # -> XComponent, YComponent, ZComponent; disabled
number_slider_34 = Slider(0.5, range=0..1)  # disabled
smaller_than = SmallerThan(FirstNumber=deconstruct_2.XComponent, SecondNumber=number_slider_34)  # -> SmallerThan, OrEqualTo; disabled
dispatch_2 = Dispatch(List=discontinuity.Points, DispatchPattern=smaller_than.SmallerThan)  # -> ListA, ListB; disabled
point_3 = Point(dispatch_2.ListB)  # disabled
point_4 = Point(dispatch_2.ListA)  # disabled

unit_y_3 = UnitY(Factor=multiplication)  # disabled
move_4 = Move(Geometry=move_3.Geometry, Motion=unit_y_3)  # -> Geometry, Transform; disabled
discontinuity_2 = Discontinuity(Curve=move_4.Geometry, Level=1)  # -> Points, Parameters; disabled
deconstruct_3 = Deconstruct(Point=discontinuity_2.Points)  # -> XComponent, YComponent, ZComponent; disabled
number_slider_35 = Slider(0.5, range=0..1)  # disabled
smaller_than_2 = SmallerThan(FirstNumber=deconstruct_3.XComponent, SecondNumber=number_slider_35)  # -> SmallerThan, OrEqualTo; disabled
dispatch_3 = Dispatch(List=discontinuity_2.Points, DispatchPattern=smaller_than_2.SmallerThan)  # -> ListA, ListB; disabled
point_5 = Point(dispatch_3.ListA)  # disabled
point_6 = Point(dispatch_3.ListB)  # disabled

# ----
series_4 = Series(Start=0, Step=1, Count=expr("x+1", number_slider_21))  # disabled
series_5 = Series(Start=0, Step=1, Count=expr("x+1", number_slider_21))  # disabled
move_5 = Move(Geometry=construct_point_4, Motion=unit_y)  # -> Geometry, Transform; disabled
number_slider_36 = Slider(100, range=0..100)  # disabled
brep = Brep(rectangle_2.Rectangle)  # disabled
explode = Explode(Curve=rectangle_2.Rectangle, Recursive=True)  # -> Segments, Vertices; disabled
construct_point_5 = ConstructPoint(XCoordinate=series_4, YCoordinate=0, ZCoordinate=expr("x*5", random_3))  # disabled
linear_regression = LinearRegression(TestData=series, TrainingInputs=random, TrainingOutput=series, RandomSeed=5)  # disabled
construct_point_6 = ConstructPoint(XCoordinate=series_4, YCoordinate=0, ZCoordinate=expr("x*5", 0))  # disabled
construct_point_7 = ConstructPoint(XCoordinate=series_5, YCoordinate=0, ZCoordinate=expr("x*5", graph_mapper))  # disabled
nonlinear_regression = NonlinearRegression(
    TestData=series_2,
    TrainingInputs=deconstruct.XComponent,
    TrainingOutput=list_length_5,
    Sigma=2,
    Complexity=100,
    RandomSeed=5)  # -> Result, Score, Error; disabled
linear_regression_2 = LinearRegression(
    TestData=series_2,
    TrainingInputs=deconstruct.XComponent,
    TrainingOutput=deconstruct.YComponent,
    RandomSeed=number_slider_16)  # disabled
populate_geometry = PopulateGeometry(Geometry=brep, Count=number_slider_33, Seed=1)  # disabled
construct_point_8 = ConstructPoint(XCoordinate=0, YCoordinate=0, ZCoordinate=0)  # disabled
galapagos = Galapagos(fitness=c_script_5, gene=[number_slider_24, number_slider_23])
curve_6 = Curve(<curve referenced from the Rhino model>)  # disabled
line = Line(StartPoint=construct_point_4, EndPoint=move_5.Geometry)  # disabled
number_slider_37 = Slider(9, range=0..10)  # disabled
list_item_3 = ListItem(List=explode.Segments, Index=0, Wrap=True)  # -> Item, Item1, Item2; disabled
nurbs_curve = NurbsCurve(Vertices=construct_point_5, Degree=3, Periodic=False)  # -> Curve, Length, Domain; disabled
number_slider_38 = Slider(15, range=0..100)  # disabled
number_slider_39 = Slider(0.557632, range=0..1)  # disabled
number_slider_40 = Slider(2.01151, range=0..100)  # disabled
number_slider_41 = Slider(2.3, range=0..10)  # disabled
number_slider_42 = Slider(1.4, range=0..10)  # disabled
number_slider_43 = Slider(0.411814, range=0..1)  # disabled
brep_2 = Brep(curve_6)  # disabled
nurbs_curve_2 = NurbsCurve(Vertices=construct_point_7, Degree=3, Periodic=False)  # -> Curve, Length, Domain; disabled
construct_point_9 = ConstructPoint(XCoordinate=series, YCoordinate=linear_regression, ZCoordinate=0)  # disabled
construct_point_10 = ConstructPoint(XCoordinate=series_2, YCoordinate=nonlinear_regression.Result, ZCoordinate=0)  # disabled
colour_swatch = ColourSwatch(SwatchColor=RGB(255, 0, 255))  # disabled
range_2 = Range(Domain=Domain(0, 1), Steps=number_slider_36)  # disabled
number_slider_44 = Slider(4, range=0..10)  # disabled
number_slider_45 = Slider(9.1, range=0..10)  # disabled
number_slider_46 = Slider(1, range=0..1)  # disabled
number_slider_47 = Slider(1, range=0..1)  # disabled
number_slider_48 = Slider(7, range=0..100)  # disabled
boolean_toggle_4 = BooleanToggle(True)  # disabled
number_slider_49 = Slider(4.5056, range=0..100)  # disabled
number_slider_50 = Slider(10, range=0..10)  # disabled
number_slider_51 = Slider(0.129024, range=0..10)  # disabled
number_slider_52 = Slider(1, range=0..10)  # disabled
number_slider_53 = Slider(0.01561, range=0..1)  # disabled
number_slider_54 = Slider(0.09239, range=0..1)  # disabled
number_slider_55 = Slider(7, range=0..10)  # disabled
number_slider_56 = Slider(0.225858, range=0..5)  # disabled
number_slider_57 = Slider(0.04212, range=-1..1)  # disabled
multivariate_linear_regression = MultivariateLinearRegression(TestData=series_4, Inputs=random_3, Output=graph_mapper, RandomSeed=number_slider_37)  # disabled
divide_curve_3 = DivideCurve(Curve=line, Count=10, Kinks=False)  # -> Points, Tangents, Parameters; disabled
circle_tantantan = CircleTanTanTan(CurveA=list_item_3.Item, CurveB=list_item_3.Item1, CurveC=list_item_3.Item2, Point=construct_point_8)  # disabled
mesh = Mesh(brep_2)  # disabled
colour_swatch_2 = ColourSwatch(SwatchColor=RGB(0, 0, 255))  # disabled
voronoi = Voronoi(Points=populate_geometry, Boundary=rectangle_2.Rectangle, BruteForceOverride=False)  # disabled
number_slider_58 = Slider(2.5, range=0..10)  # disabled
number_slider_59 = Slider(4, range=0..10)  # disabled

# ---- group: Logic
discontinuity_3 = Discontinuity(Curve=rectangle_3.Rectangle, Level=1)  # -> Points, Parameters; disabled
deconstruct_4 = Deconstruct(Point=discontinuity_3.Points)  # -> XComponent, YComponent, ZComponent; disabled
number_slider_60 = Slider(0.5, range=0..1)  # disabled
smaller_than_3 = SmallerThan(FirstNumber=deconstruct_4.XComponent, SecondNumber=number_slider_60)  # -> SmallerThan, OrEqualTo; disabled
dispatch_4 = Dispatch(List=discontinuity_3.Points, DispatchPattern=smaller_than_3.SmallerThan)  # -> ListA, ListB; disabled
point_7 = Point(dispatch_4.ListA)  # disabled
point_8 = Point(dispatch_4.ListB)  # disabled

# ----
custom_preview = CustomPreview(Geometry=nurbs_curve_2.Curve, Shader=colour_swatch)  # disabled
point_9 = Point([<point referenced from the Rhino model> x4])  # disabled
quadtree = QuadTree(Points=populate_geometry, Plane=PlaneXY(0, 0, 0), Square=True, Group=number_slider_48)  # -> Quads, Points; disabled
c_script_6 = CSharpScript(
    numPoi=number_slider_38,
    disPoi=number_slider_43,
    amp=number_slider_39,
    fre=number_slider_40,
    ampOne=number_slider_41,
    freOne=number_slider_42,
    iter=number_slider_44)  # -> A; inputs numPoi: Int32, disPoi: Double, amp: Double, fre: Double, ampOne: Double, freOne: Double, iter: Int32; disabled
# ---------- c_script_6: C# ----------
    var tree = new DataTree<Point3d>();
    var list = new List<Point3d>();

    for( int i = 0; i < numPoi; ++i )
      for( int j = 0; j < numPoi; ++j )
      {

        var path = new GH_Path(i);
        /*
        var path = new GH_Path( i );
        tree.Add( new Point3d( i, j, 0 ), path );
        */
        tree.Add(new Point3d(i, j, ampOne * fbm(new Point2d(i * freOne, j * freOne), amp, fre, iter)), path);

        //list.Add(new Point3d(i, j, 0));

      }

    A = tree;
# ---------- c_script_6: C# additional code ----------
  public static double Frac(double value)
  {
    return value - Math.Truncate(value);
  }

  public double Lerp(double a, double b, double t)
  {
    //return firstFloat * by + secondFloat * (1 - by);
    return (1f - t) * a + t * b;
  }

  public Point2d Lerp(Point2d a, Point2d b, double t)
  {
    double retX = Lerp(a.X, b.X, t);
    double retY = Lerp(a.Y, b.Y, t);
    return new Point2d(retX, retY);
  }

  private double hash(Point2d uv)
  {

    return Frac(Math.Sin(uv.X * 45164.185 + uv.Y * 4155.15) * 44513.541);

  }

  private double noise(Point2d uv)
  {

    Point2d id = new Point2d(Math.Floor(uv.X), Math.Floor(uv.Y));
    Point2d lv = new Point2d(Frac(uv.X), Frac(uv.Y));

    double bl = hash(id);
    double br = hash(id + new Point2d(1, 0));
    double b = Lerp(bl, br, lv.X);

    double tl = hash(id + new Point2d(1, 0));
    double tr = hash(id + new Point2d(1, 1));
    double t = Lerp(tl, tr, lv.X);

    double final = Lerp(b, t, lv.Y);

    return final;

  }

  private double fbm(Point2d uv, double amp, double fre, int iter)
  {

    double res = 0, div = 0, ampTemp = 1, freTemp = 1;

    for( int i = 0; i < iter; ++i )
    {

      ampTemp *= amp;
      freTemp *= fre;
      res += ampTemp * noise(uv * freTemp);
      div += ampTemp;

    }

    res /= div;

    return res;

  }

  /// <summary>
  /// This method will be called once every solution, before any calls to RunScript.
  /// </summary>
  public override void BeforeRunScript()
  { }
  /// <summary>
  /// This method will be called once every solution, after any calls to RunScript.
  /// </summary>
  public override void AfterRunScript()
  { }
# ---------- end c_script_6 ----------
polyline_6 = PolyLine(Vertices=construct_point_9, Closed=False)  # disabled
mobius_surface = MobiusSurface(
    UDivisions=100,
    VDivisions=100,
    RParameter=number_slider_45,
    TParameter=number_slider_46,
    Scale=expr("x*1.2", number_slider_47),
    Domain1=Domain(-3.141592654, 3.141592654),
    Domain2=Domain(-1, 1))  # disabled
graph_mapper_2 = GraphMapper(range_2, x0=0, x1=1, y0=0, y1=1, A=1, B=0, container_name="Linear")  # disabled
klein_surface = KleinSurface(
    UDivisions=96,
    VDivisions=91,
    RParameter=3,
    TParameter=0.5,
    Scale=5,
    Domain1=Domain(0, 12.56637061),
    Domain2=Domain(0, 3.141592654))  # disabled
mobius_surface_2 = MobiusSurface(
    UDivisions=100,
    VDivisions=100,
    RParameter=number_slider_45,
    TParameter=number_slider_46,
    Scale=number_slider_47,
    Domain1=Domain(-3.141592654, 3.141592654),
    Domain2=Domain(-1, 1))  # disabled
c_script_7 = CSharpScript(
    pts=number_slider_55,
    amp=number_slider_56,
    fre=number_slider_49,
    iter=number_slider_50,
    ampO=number_slider_51,
    freO=number_slider_52,
    flip=boolean_toggle_4,
    paraAmp=number_slider_53,
    para=number_slider_54,
    paraAmpO=number_slider_57)  # -> out, A; inputs pts: Int32, amp: Double, fre: Double, iter: Int32, ampO: Double, freO: Double, flip: Boolean, paraAmp: Double, para: Double, paraAmpO: Double; disabled
# ---------- c_script_7: C# ----------
    var list = new DataTree<Point3d>();

    for( int i = 0; i < pts; ++i )
      for( int j = 0; j < pts * 2; ++j )
      {

        var path = new GH_Path(i);

        var f = ( ampO * 4 ) * fbm(new Point2d(i * ( freO * 4 ), j * ( freO * 4 )), amp, fre, iter);

        if( flip == false )
          list.Add(new Point3d(i, j, (paraAmp * (i * i) + paraAmp * (i)) + f), path);
        else
          list.Add(new Point3d(i, j, ( paraAmp * para * -(i * i * i * i) + paraAmp * -(i) ) + f), path);

      }

    for( int i = -pts; i < 0; ++i )
      for( int j = -pts * 2; j < 0; ++j )
      {

        var path = new GH_Path(i);

        var f = ampO * fbm(new Point2d(i * freO, j * freO), amp, fre, iter);

        if( flip == false )
          list.Add(new Point3d(i, j + ( pts * 2 ), paraAmpO * (i * i) + paraAmp * (i) + f), path);
        else
          list.Add(new Point3d(i, j + ( pts * 2 ), paraAmpO * -(i * i) + paraAmp * -(i) + f), path);
      }

    A = list;
# ---------- c_script_7: C# additional code ----------
  public static double Frac(double value)
  {
    return value - Math.Truncate(value);
  }

  public double Lerp(double a, double b, double t)
  {
    //return firstFloat * by + secondFloat * (1 - by);
    return (1f - t) * a + t * b;
  }

  public Point2d Lerp(Point2d a, Point2d b, double t)
  {
    double retX = Lerp(a.X, b.X, t);
    double retY = Lerp(a.Y, b.Y, t);
    return new Point2d(retX, retY);
  }

  private double hash(Point2d uv)
  {

    return Frac(Math.Sin(uv.X * 45164.185 + uv.Y * 4155.15) * 44513.541);

  }

  private double noise(Point2d uv)
  {

    Point2d id = new Point2d(Math.Floor(uv.X), Math.Floor(uv.Y));
    Point2d lv = new Point2d(Frac(uv.X), Frac(uv.Y));

    double bl = hash(id);
    double br = hash(id + new Point2d(1, 0));
    double b = Lerp(bl, br, lv.X);

    double tl = hash(id + new Point2d(1, 0));
    double tr = hash(id + new Point2d(1, 1));
    double t = Lerp(tl, tr, lv.X);

    double final = Lerp(b, t, lv.Y);

    return final;

  }

  private double fbm(Point2d uv, double amp, double fre, int iter)
  {

    double res = 0, div = 0, ampTemp = 1, freTemp = 1;

    for( int i = 0; i < iter; ++i )
    {

      ampTemp *= amp;
      freTemp *= fre;
      res += ampTemp * noise(uv * freTemp);
      div += ampTemp;

    }

    res /= div;

    return res;

  }
# ---------- end c_script_7 ----------
series_6 = Series(Start=0, Step=1, Count=expr("x+1", number_slider_21))  # disabled
number_slider_61 = Slider(100, range=0..100)  # disabled
custom_preview_2 = CustomPreview(Geometry=nurbs_curve.Curve, Shader=colour_swatch_2)  # disabled
construct_domain_7 = ConstructDomain(DomainStart=number_slider_58, DomainEnd=number_slider_59)  # disabled
shatter = Shatter(Curve=line, Parameters=divide_curve_3.Parameters)  # disabled
curve_7 = Curve(quadtree.Quads)  # disabled
list_length_6 = ListLength(List=curve_7)  # disabled
c_script_8 = CSharpScript()  # -> out, A, B; disabled
# ---------- c_script_8: C# ----------
    var points = new List<Point3d>();
    var pointsOne = new List<Point3d>();

    for( int i = 0; i < 10; ++i )
    {

      points.Add(new Point3d(i, 0, 0.4 * Math.Cos(i) * ( i * i )));

    }

    A = points;

    /*
    for( int i = -10; i < 0; ++i )
    {

      pointsOne.Add(new Point3d(i, 0, 0.01 * Math.Cos(i) * ( i * i )));

    }

    B = pointsOne;
    */
# ---------- end c_script_8 ----------
construct_point_11 = ConstructPoint(XCoordinate=series_6, YCoordinate=0, ZCoordinate=expr("x*5", multivariate_linear_regression))  # disabled
flip_matrix_4 = FlipMatrix(Data=c_script_6)  # disabled
panel_6 = Panel("{+1}[-1]")  # disabled
panel_7 = Panel("{+1}[+1]")  # disabled
number_slider_62 = Slider(1, range=0..100)  # disabled
xy_plane = XYPlane(Origin=Point(0, 0, 0))  # disabled
unit_z_3 = UnitZ(Factor=1)  # disabled
mirror = Mirror(Geometry=c_script_8.A, Plane=xy_plane)  # -> Geometry, Transform; disabled
random_4 = Random(Range=construct_domain_7, Number=list_length_6, Seed=2)  # disabled
unit_z_4 = UnitZ(Factor=random_4)  # disabled
extrude_2 = Extrude(Base=curve_7, Direction=unit_z_4)  # disabled
move_6 = Move(Geometry=quadtree.Points, Motion=unit_z_4)  # -> Geometry, Transform; disabled
flip_matrix_5 = FlipMatrix(Data=c_script_7.A)  # disabled
deconstruct_brep = DeconstructBrep(Brep=mobius_surface_2)  # -> Faces, Edges, Vertices; disabled
divide_surface = DivideSurface(Surface=mobius_surface_2, UCount=number_slider_61, VCount=number_slider_61)  # -> Points, Normals, Parameters; disabled
divide_surface_2 = DivideSurface(Surface=mobius_surface, UCount=number_slider_61, VCount=number_slider_61)  # -> Points, Normals, Parameters; disabled
construct_point_12 = ConstructPoint(XCoordinate=graph_mapper_2, YCoordinate=0, ZCoordinate=expr("-x", graph_mapper_2))  # disabled
panel_8 = Panel("{+1}[-1]")  # disabled
panel_9 = Panel("{+1}[+1]")  # disabled
surface_from_points_2 = SurfaceFromPoints(Points=flatten(c_script_6), UCount=number_slider_38, Interpolate=False)  # disabled
construct_point_13 = ConstructPoint(XCoordinate=graph_mapper_2, YCoordinate=0, ZCoordinate=graph_mapper_2)  # disabled
number_slider_63 = Slider(3.161441, range=0..5)  # disabled
number_slider_64 = Slider(0.578643, range=0..1)  # disabled
number_slider_65 = Slider(5, range=0..10)  # disabled
deconstruct_brep_2 = DeconstructBrep(Brep=mobius_surface)  # -> Faces, Edges, Vertices; disabled
surface_from_points_3 = SurfaceFromPoints(Points=flatten(c_script_7.A), UCount=expr("x*2", number_slider_55), Interpolate=False)  # disabled
polyline_7 = PolyLine(Vertices=c_script_6, Closed=False)  # disabled
number_slider_66 = Slider(229, range=0..1000)  # disabled
nurbs_curve_3 = NurbsCurve(Vertices=construct_point_11, Degree=3, Periodic=False)  # -> Curve, Length, Domain; disabled
polyline_8 = PolyLine(Vertices=flip_matrix_4, Closed=False)  # disabled
unit_x = UnitX(Factor=1)  # disabled
unaryforce = UnaryForce(Point=divide_curve_3.Points, Force=unit_z_3)  # disabled
list_item_4 = ListItem(List=mobius_surface_2, Index=0, Wrap=True)  # disabled
number_slider_67 = Slider(8, range=0..10)  # disabled
panel_10 = Panel("-35 To 35")  # disabled
unit_y_4 = UnitY(Factor=1)  # disabled
unit_y_5 = UnitY(Factor=number_slider_65)  # disabled
colour_swatch_3 = ColourSwatch(SwatchColor=RGB(255, 0, 0))  # disabled
relative_item_3 = RelativeItem(Tree=c_script_6, Offset=panel_6, WrapPaths=False, WrapItems=False)  # -> ItemA, ItemB; disabled
relative_item_4 = RelativeItem(Tree=c_script_6, Offset=panel_7, WrapPaths=False, WrapItems=False)  # -> ItemA, ItemB; disabled
curve_8 = Curve(deconstruct_brep.Edges)  # disabled
polyline_9 = PolyLine(Vertices=divide_surface.Points, Closed=False)  # -> flatten(Polyline); disabled
unit_y_6 = UnitY(Factor=number_slider_62)  # disabled
unit_z_5 = UnitZ(Factor=number_slider_62)  # disabled
cap_holes_2 = CapHoles(Brep=extrude_2)  # disabled
polyline_10 = PolyLine(Vertices=c_script_7.A, Closed=False)  # disabled
nurbs_curve_4 = NurbsCurve(Vertices=c_script_7.A, Degree=3, Periodic=False)  # -> Curve, Length, Domain; disabled
polyline_11 = PolyLine(Vertices=flip_matrix_5, Closed=False)  # disabled
nurbs_curve_5 = NurbsCurve(Vertices=flip_matrix_5, Degree=3, Periodic=False)  # -> Curve, Length, Domain; disabled
list_item_5 = ListItem(List=curve_8, Index=0, Wrap=True)  # disabled
curve_9 = Curve(deconstruct_brep_2.Edges)  # disabled
move_7 = Move(Geometry=mirror.Geometry, Motion=unit_y_5)  # -> Geometry, Transform; disabled
list_item_6 = ListItem(List=flatten(c_script_7.A), Index=number_slider_66, Wrap=True)  # disabled
rectangle_4 = Rectangle(Plane=PlaneXY(0, 0, 0), XSize=panel_10, YSize=panel_10, Radius=0)  # -> Rectangle, Length; disabled
list_item_7 = ListItem(List=curve_9, Index=0, Wrap=True)  # disabled
relative_item_5 = RelativeItem(Tree=c_script_7.A, Offset=panel_8, WrapPaths=False, WrapItems=False)  # -> ItemA, ItemB; disabled
relative_item_6 = RelativeItem(Tree=c_script_7.A, Offset=panel_9, WrapPaths=False, WrapItems=False)  # -> ItemA, ItemB; disabled
contour_2 = Contour(Shape=surface_from_points_3, Point=Point(0, 0, 0), Direction=unit_y_4, Distance=number_slider_63)  # disabled
contour_3 = Contour(
    Shape=surface_from_points_3,
    Point=Point(0, 0, 0),
    Direction=Vector(1.044357889, 1.049328963, 0),
    Distance=number_slider_64)  # disabled
area = Area(Geometry=cap_holes_2)  # -> Area, Centroid; disabled
custom_preview_3 = CustomPreview(Geometry=nurbs_curve_3.Curve, Shader=colour_swatch_3)  # disabled
line_2 = Line(StartPoint=relative_item_3.ItemA, EndPoint=relative_item_3.ItemB)  # disabled
line_3 = Line(StartPoint=relative_item_4.ItemA, EndPoint=relative_item_4.ItemB)  # disabled
move_8 = Move(Geometry=construct_point_12, Motion=unit_z_5)  # -> Geometry, Transform; disabled
springsfromline = SpringsFromLine(Connection=shatter, Stiffness=1000, Damping=10, RestLength=shatter, UpperCutoff=0, LowerCutoff=0, Plasticity=0)  # disabled
delaunay_mesh = DelaunayMesh(Points=flatten(c_script_7.A), Plane=PlaneXY(0, 0, 0))  # disabled
weaverbird_s_split_triangles_subdivision = WeaverbirdsSplitTrianglesSubdivision(MeshCurves=mesh, Level=number_slider_67)  # disabled
list_item_8 = ListItem(List=divide_surface_2.Points, Index=0, Wrap=True)  # disabled
number_slider_68 = Slider(0.9, range=0..1)  # disabled
number_slider_69 = Slider(0.16, range=0..1)  # disabled
number_slider_70 = Slider(0.3, range=0..1)  # disabled
line_4 = Line(StartPoint=relative_item_5.ItemA, EndPoint=relative_item_5.ItemB)  # disabled
line_5 = Line(StartPoint=relative_item_6.ItemA, EndPoint=relative_item_6.ItemB)  # disabled
surface = Surface(rectangle_4.Rectangle)  # disabled
list_length_7 = ListLength(List=flatten(polyline_10))  # disabled
number_slider_71 = Slider(3.539, range=0..50)  # disabled
line_6 = Line(StartPoint=c_script_8.A, EndPoint=move_7.Geometry)  # disabled
list_item_9 = ListItem(List=divide_surface.Points, Index=0, Wrap=True)  # disabled
number_slider_72 = Slider(17, range=0..100)  # disabled
list_length_8 = ListLength(List=flatten(polyline_10))  # disabled
number_slider_73 = Slider(1, range=0..1)  # disabled
unit_z_6 = UnitZ(Factor=1)  # -> expr("-x", UnitVector); disabled
number_slider_74 = Slider(0.5, range=0..1)  # disabled
button = Button()  # disabled
mass_addition = MassAddition(Input=area.Area)  # -> Result, PartialResults; disabled
mirror_2 = Mirror(Geometry=line_6, Plane=PlaneYZ(0, 0, 0))  # -> Geometry, Transform; disabled
move_9 = Move(Geometry=move_8.Geometry, Motion=unit_y_6)  # -> Geometry, Transform; disabled
unit_x_2 = UnitX(Factor=1)  # disabled
number_slider_75 = Slider(0.6189, range=0..1)  # disabled
extrude_3 = Extrude(Base=surface, Direction=unit_z_6)  # disabled
split_brep = SplitBrep(Brep=klein_surface, Cutter=extrude_3)  # disabled
list_item_10 = ListItem(List=split_brep, Index=0, Wrap=True)  # disabled
number_slider_76 = Slider(1, range=0..1)  # disabled
join_curves = JoinCurves(Curves=flatten(line_4), Preserve=False)  # disabled
list_length_9 = ListLength(List=join_curves)  # -> expr("x-1", Length); disabled
curve_10 = Curve([polyline_7, polyline_8, line_3, line_2])  # disabled
number_slider_77 = Slider(0, range=0..100)  # disabled
subtraction_2 = Subtraction(A=list_length_7, B=number_slider_73)  # disabled
kangaroophysics = KangarooPhysics(
    ForceObjects=[springsfromline, unaryforce],
    AnchorPoints=divide_curve_3.Points,
    Settings=null,
    Geometry=shatter,
    SimulationReset=button)  # -> Out, Iterations, ParticlesOut, GeometryOut, KE; disabled
subtraction_3 = Subtraction(A=list_length_8, B=number_slider_73)  # disabled
number_slider_78 = Slider(0.8, range=0..1)  # disabled
panel_11 = Panel(mass_addition.Result)  # disabled
timer = Timer(TimerInterval=20, Target=kangaroophysics)  # disabled
line_7 = Line(StartPoint=construct_point_13, EndPoint=move_9.Geometry)  # disabled
contour_4 = Contour(Shape=list_item_10, Point=Point(0, 0, 0), Direction=unit_x_2, Distance=number_slider_74)  # disabled
number_slider_79 = Slider(16, range=0..30)  # disabled
series_7 = Series(Start=0, Step=number_slider_71, Count=number_slider_79)  # disabled
division_2 = Division(A=list_length_9, B=2)  # disabled
list_item_11 = ListItem(List=flatten(polyline_10), Index=0, Wrap=True)  # disabled
construct_point_14 = ConstructPoint(XCoordinate=0, YCoordinate=0, ZCoordinate=0)  # disabled
list_item_12 = ListItem(List=flatten(polyline_10), Index=subtraction_3, Wrap=True)  # disabled
list_item_13 = ListItem(List=flatten(polyline_11), Index=0, Wrap=True)  # disabled
list_item_14 = ListItem(List=flatten(polyline_11), Index=subtraction_2, Wrap=True)  # disabled
mesh_2 = Mesh(surface_from_points_2)  # disabled
unit_z_7 = UnitZ(Factor=1)  # -> expr("-x", UnitVector); disabled
unit_z_8 = UnitZ(Factor=1)  # disabled
curve_11 = Curve([line_6, mirror_2.Geometry])  # disabled
panel_12 = Panel("-3.5 To 3.5")  # disabled
series_8 = Series(Start=number_slider_76, Step=number_slider_75, Count=expr("x+1", number_slider_79))  # disabled

# ---- group: XVector
number_slider_80 = Slider(0.4, range=0..7)  # disabled
number_slider_81 = Slider(2, range=0..7)  # disabled
unit_x_3 = UnitX(Factor=number_slider_80)  # disabled
unit_x_4 = UnitX(Factor=number_slider_81)  # disabled
move_10 = Move(Geometry=point_7, Motion=unit_x_4)  # -> Geometry, Transform; disabled
move_11 = Move(Geometry=point_8, Motion=unit_x_3)  # -> Geometry, Transform; disabled

number_slider_82 = Slider(1, range=0..7)  # disabled
number_slider_83 = Slider(1.7, range=0..7)  # disabled
unit_x_5 = UnitX(Factor=number_slider_82)  # disabled
unit_x_6 = UnitX(Factor=number_slider_83)  # disabled
move_12 = Move(Geometry=point_4, Motion=unit_x_6)  # -> Geometry, Transform; disabled
move_13 = Move(Geometry=point_3, Motion=unit_x_5)  # -> Geometry, Transform; disabled

number_slider_84 = Slider(1.9, range=0..7)  # disabled
number_slider_85 = Slider(1.4, range=0..7)  # disabled
unit_x_7 = UnitX(Factor=number_slider_84)  # disabled
unit_x_8 = UnitX(Factor=number_slider_85)  # disabled
move_14 = Move(Geometry=point_5, Motion=unit_x_8)  # -> Geometry, Transform; disabled
move_15 = Move(Geometry=point_6, Motion=unit_x_7)  # -> Geometry, Transform; disabled

# ----
curve_12 = Curve(flatten([polyline_10, polyline_11, line_5, line_4]))  # disabled
deconstruct_mesh = DeconstructMesh(Mesh=mesh_2)  # -> Vertices, Faces, Colours, Normals; disabled
radians = Radians(Degrees=series_7)  # disabled
number_slider_86 = Slider(5, range=0..10)
subtraction_4 = Subtraction(A=division_2, B=1)  # disabled
list_item_15 = ListItem(List=join_curves, Index=subtraction_4, Wrap=True)  # disabled
mirror_3 = Mirror(Geometry=line_7, Plane=PlaneYZ(0, 0, 0))  # -> Geometry, Transform; disabled
springsfrommesh = SpringsFromMesh(M=mesh_2, stiffness=1000, B=number_slider_78)  # disabled
discontinuity_4 = Discontinuity(Curve=list_item_11, Level=1)  # -> Points, Parameters; disabled
discontinuity_5 = Discontinuity(Curve=list_item_12, Level=1)  # -> Points, Parameters; disabled
discontinuity_6 = Discontinuity(Curve=list_item_13, Level=1)  # -> Points, Parameters; disabled
discontinuity_7 = Discontinuity(Curve=list_item_14, Level=1)  # -> Points, Parameters; disabled
number_slider_87 = Slider(-3.65, range=-6..3)  # disabled
line_to_beam_karamba = LineToBeamKaramba(Line=curve_12, New=True, Remove=True, LimitDistance_m=0.005)  # -> Points, Element, Info; disabled
rectangle_5 = Rectangle(Plane=construct_point_14, XSize=panel_12, YSize=panel_12, Radius=0)  # -> Rectangle, Length; disabled
end_points = EndPoints(Curve=list_item_11)  # -> Start, End; disabled
end_points_2 = EndPoints(Curve=list_item_12)  # -> Start, End; disabled
end_points_3 = EndPoints(Curve=list_item_13)  # -> Start, End; disabled
end_points_4 = EndPoints(Curve=list_item_14)  # -> Start, End; disabled
extrude_4 = Extrude(Base=list_item_15, Direction=[unit_z_7, unit_z_8])  # disabled
rotate = Rotate(Geometry=rectangle_5.Rectangle, Angle=radians, Plane=PlaneXY(0, 0, 0))  # -> Geometry, Transform; disabled
xz_plane = XZPlane(Origin=Point(0, 0, 0))  # disabled
number_slider_88 = Slider(1, range=0..1)  # disabled
button_2 = Button()  # disabled
mirror_4 = Mirror(Geometry=curve_11, Plane=xz_plane)  # -> Geometry, Transform; disabled
construct_domain_8 = ConstructDomain(DomainStart=expr("-x", number_slider_86), DomainEnd=number_slider_86)
kangaroophysics_2 = KangarooPhysics(
    ForceObjects=springsfrommesh,
    AnchorPoints=c_script_6,
    Settings=null,
    Geometry=deconstruct_mesh.Vertices,
    SimulationReset=button_2)  # -> Out, Iterations, ParticlesOut, GeometryOut, KE; disabled
scale = Scale(Geometry=rotate.Geometry, Center=Point(0, 0, 0), Factor=series_8)  # -> Geometry, Transform; disabled
timer_2 = Timer(TimerInterval=20, Target=kangaroophysics_2)  # disabled
explode_2 = Explode(Curve=rectangle_5.Rectangle, Recursive=True)  # -> Segments, Vertices; disabled
brep_join = BrepJoin(Breps=extrude_4)  # -> Breps, Closed; disabled
curve_13 = Curve([mirror_3.Geometry, line_7])  # disabled
split_brep_2 = SplitBrep(Brep=surface_from_points_3, Cutter=brep_join.Breps)  # disabled
number_slider_89 = Slider(1, range=0..10)  # disabled
construct_point_15 = ConstructPoint(XCoordinate=0, YCoordinate=0, ZCoordinate=0)
number_slider_90 = Slider(1000, range=0..1000)  # disabled
number_slider_91 = Slider(0.777179, range=0..1)  # disabled
boolean_toggle_5 = BooleanToggle(True)  # disabled
point_10 = Point([end_points_3.End, end_points.Start, end_points_2.End, end_points_4.Start, list_item_6])  # disabled
cloth_from_mesh = ClothFromMesh(
    ClothMeshes=weaverbird_s_split_triangles_subdivision,
    Masses=number_slider_70,
    StretchStiffness=number_slider_68,
    BendingStiffness=number_slider_69,
    SelfCollision=False,
    PreTension=1,
    Anchors=point_10,
    GroupIndex=number_slider_77)  # disabled
flex_scene = FlexScene(Cloth=flatten(cloth_from_mesh))  # disabled
point_11 = Point([discontinuity_6.Points, discontinuity_7.Points])  # disabled
button_3 = Button()  # disabled
divide_length = DivideLength(Curve=rectangle_5.Rectangle, Distance=number_slider_88, RoundUp=False, RoundDn=False)  # disabled
construct_point_16 = ConstructPoint(XCoordinate=0, YCoordinate=0, ZCoordinate=0)  # disabled
deconstruct_5 = Deconstruct(Point=line_to_beam_karamba.Points)  # -> XComponent, YComponent, ZComponent; disabled
smaller_than_4 = SmallerThan(FirstNumber=deconstruct_5.ZComponent, SecondNumber=number_slider_87)  # -> SmallerThan, OrEqualTo; disabled
curve_14 = Curve([mirror_4.Geometry, curve_11])  # disabled
mesh_3 = Mesh(weaverbird_s_split_triangles_subdivision)  # disabled
xy_plane_2 = XYPlane(Origin=Point(0, 0, 0))  # disabled
xz_plane_2 = XZPlane(Origin=Point(0, 0, 0))  # disabled
list_item_16 = ListItem(List=explode_2.Segments, Index=0, Wrap=True)  # -> Item, Item1, Item2; disabled
list_item_17 = ListItem(List=split_brep_2, Index=0, Wrap=True)  # disabled
rectangle_6 = Rectangle(Plane=construct_point_15, XSize=construct_domain_8, YSize=construct_domain_8, Radius=0)  # -> Rectangle, Length

# ---- group: ZVector
number_slider_92 = Slider(4.4, range=0..10)  # disabled
number_slider_93 = Slider(3, range=0..10)  # disabled
unit_z_9 = UnitZ(Factor=number_slider_93)  # disabled
unit_z_10 = UnitZ(Factor=number_slider_92)  # disabled
move_16 = Move(Geometry=move_10.Geometry, Motion=unit_z_9)  # -> Geometry, Transform; disabled
move_17 = Move(Geometry=move_11.Geometry, Motion=unit_z_10)  # -> Geometry, Transform; disabled

number_slider_94 = Slider(3.1, range=0..10)  # disabled
number_slider_95 = Slider(5, range=0..10)  # disabled
unit_z_11 = UnitZ(Factor=number_slider_94)  # disabled
unit_z_12 = UnitZ(Factor=number_slider_95)  # disabled
move_18 = Move(Geometry=move_12.Geometry, Motion=unit_z_11)  # -> Geometry, Transform; disabled
move_19 = Move(Geometry=move_13.Geometry, Motion=unit_z_12)  # -> Geometry, Transform; disabled

number_slider_96 = Slider(3.3, range=0..10)  # disabled
number_slider_97 = Slider(5.9, range=0..10)  # disabled
unit_z_13 = UnitZ(Factor=number_slider_96)  # disabled
unit_z_14 = UnitZ(Factor=number_slider_97)  # disabled
move_20 = Move(Geometry=move_14.Geometry, Motion=unit_z_13)  # -> Geometry, Transform; disabled
move_21 = Move(Geometry=move_15.Geometry, Motion=unit_z_14)  # -> Geometry, Transform; disabled

# ----
deconstruct_mesh_2 = DeconstructMesh(Mesh=mesh_3)  # -> Vertices, Faces, Colours, Normals; disabled
mirror_5 = Mirror(Geometry=curve_13, Plane=xz_plane_2)  # -> Geometry, Transform; disabled
mirror_6 = Mirror(Geometry=curve_14, Plane=xy_plane_2)  # -> Geometry, Transform; disabled
series_9 = Series(Start=expr("-x", number_slider_79), Step=number_slider_89, Count=number_slider_79)  # disabled
flex_engine = FlexEngine(FlexScene=flatten(flex_scene), Reset=button_3, Go=boolean_toggle_5)  # -> FlexObject, Information; disabled
construct_mesh = ConstructMesh(Vertices=kangaroophysics_2.GeometryOut, Faces=deconstruct_mesh.Faces)  # disabled
unit_z_15 = UnitZ(Factor=expr("-x", series_9))  # disabled
springsfrommesh_2 = SpringsFromMesh(M=weaverbird_s_split_triangles_subdivision, stiffness=number_slider_90, B=number_slider_91)  # disabled
cull_pattern_3 = CullPattern(List=line_to_beam_karamba.Points, CullPattern=smaller_than_4.SmallerThan)  # disabled
number_slider_98 = Slider(23, range=0..50)  # disabled
circle_tantantan_2 = CircleTanTanTan(CurveA=list_item_16.Item, CurveB=list_item_16.Item1, CurveC=list_item_16.Item2, Point=construct_point_16)  # disabled
explode_3 = Explode(Curve=rectangle_6.Rectangle, Recursive=True)  # -> Segments, Vertices
list_item_18 = ListItem(List=explode_3.Segments, Index=0, Wrap=True)  # -> Item, Item1, Item2
circle_tantantan_3 = CircleTanTanTan(CurveA=list_item_18.Item, CurveB=list_item_18.Item1, CurveC=list_item_18.Item2, Point=construct_point_15)
button_4 = Button()  # disabled
loft = Loft(Curves=line_7, Options={Adjust=False, Closed=False, LoftEnds=0, LoftSimp=0, LoftType=0, Rebuild=10, Refit=0.01})  # disabled
loft_2 = Loft(
    Curves=mirror_3.Geometry,
    Options={Adjust=False, Closed=False, LoftEnds=0, LoftSimp=0, LoftType=0, Rebuild=10, Refit=0.01})  # disabled
mirror_7 = Mirror(Geometry=[loft_2, loft], Plane=xz_plane_2)  # -> Geometry, Transform; disabled
divide_curve_4 = DivideCurve(Curve=mirror_6.Geometry, Count=10, Kinks=False)  # -> flatten(Points), Tangents, Parameters; disabled
move_22 = Move(Geometry=scale.Geometry, Motion=unit_z_15)  # -> Geometry, Transform; disabled
curve_15 = Curve([mirror_5.Geometry, curve_13])  # disabled
kangaroophysics_3 = KangarooPhysics(
    ForceObjects=springsfrommesh_2,
    AnchorPoints=point_9,
    Settings=null,
    Geometry=deconstruct_mesh_2.Vertices,
    SimulationReset=button_4)  # -> Out, Iterations, ParticlesOut, GeometryOut, KE; disabled
timer_3 = Timer(TimerInterval=20, Target=kangaroophysics_3)  # disabled
xy_plane_3 = XYPlane(Origin=Point(0, 0, 0))  # disabled
divide_curve_5 = DivideCurve(Curve=circle_tantantan_2, Count=number_slider_98, Kinks=False)  # -> Points, Tangents, Parameters; disabled
construct_point_17 = ConstructPoint(XCoordinate=0, YCoordinate=0, ZCoordinate=0)
assemble_model_karamba = AssembleModelKaramba(Elem=line_to_beam_karamba.Element, LimitDistance_m=0.005)  # -> Model, Info, Mass_kg, CenterOfGravity; disabled
get_cloths = GetCloths(FlexObject=flex_engine.FlexObject, N=1, ClothObject=cloth_from_mesh)  # -> Points, Vector, Meshes; disabled
mirror_8 = Mirror(Geometry=curve_15, Plane=xy_plane_3)  # -> Geometry, Transform; disabled
brep_join_2 = BrepJoin(Breps=[loft, loft_2, mirror_7.Geometry])  # -> Breps, Closed; disabled
list_length_10 = ListLength(List=divide_curve_4.Points)  # disabled
number_slider_99 = Slider(10, range=0..10)  # disabled
loft_3 = Loft(
    Curves=move_22.Geometry,
    Options={Adjust=False, Closed=False, LoftEnds=0, LoftSimp=0, LoftType=0, Rebuild=10, Refit=0.01})  # disabled
mirror_9 = Mirror(Geometry=brep_join_2.Breps, Plane=xy_plane_3)  # -> Geometry, Transform; disabled
divide_curve_6 = DivideCurve(Curve=mirror_8.Geometry, Count=number_slider_99, Kinks=False)  # -> flatten(Points), Tangents, Parameters; disabled
construct_mesh_2 = ConstructMesh(Vertices=kangaroophysics_3.GeometryOut, Faces=deconstruct_mesh_2.Faces)  # disabled

# ---- group: Geo
line_8 = Line(StartPoint=point_7, EndPoint=move_16.Geometry)  # disabled
line_9 = Line(StartPoint=move_16.Geometry, EndPoint=move_17.Geometry)  # disabled
line_10 = Line(StartPoint=move_17.Geometry, EndPoint=point_8)  # disabled
line_11 = Line(StartPoint=point_7, EndPoint=point_8)  # disabled
loft_4 = Loft(Curves=line_8, Options={Adjust=False, Closed=False, LoftEnds=0, LoftSimp=0, LoftType=0, Rebuild=10, Refit=0.01})  # disabled
loft_5 = Loft(Curves=line_9, Options={Adjust=False, Closed=False, LoftEnds=0, LoftSimp=0, LoftType=0, Rebuild=10, Refit=0.01})  # disabled
loft_6 = Loft(Curves=line_10, Options={Adjust=False, Closed=False, LoftEnds=0, LoftSimp=0, LoftType=0, Rebuild=10, Refit=0.01})  # disabled
loft_7 = Loft(Curves=line_11, Options={Adjust=False, Closed=False, LoftEnds=0, LoftSimp=0, LoftType=0, Rebuild=10, Refit=0.01})  # disabled
brep_join_3 = BrepJoin(Breps=[loft_4, loft_5, loft_6, loft_7])  # -> Breps, Closed; disabled

line_12 = Line(StartPoint=point_4, EndPoint=move_18.Geometry)  # disabled
line_13 = Line(StartPoint=move_18.Geometry, EndPoint=move_19.Geometry)  # disabled
line_14 = Line(StartPoint=move_19.Geometry, EndPoint=point_3)  # disabled
line_15 = Line(StartPoint=point_4, EndPoint=point_3)  # disabled
loft_8 = Loft(Curves=line_12, Options={Adjust=False, Closed=False, LoftEnds=0, LoftSimp=0, LoftType=0, Rebuild=10, Refit=0.01})  # disabled
loft_9 = Loft(Curves=line_13, Options={Adjust=False, Closed=False, LoftEnds=0, LoftSimp=0, LoftType=0, Rebuild=10, Refit=0.01})  # disabled
loft_10 = Loft(Curves=line_14, Options={Adjust=False, Closed=False, LoftEnds=0, LoftSimp=0, LoftType=0, Rebuild=10, Refit=0.01})  # disabled
loft_11 = Loft(Curves=line_15, Options={Adjust=False, Closed=False, LoftEnds=0, LoftSimp=0, LoftType=0, Rebuild=10, Refit=0.01})  # disabled
brep_join_4 = BrepJoin(Breps=[loft_8, loft_9, loft_10, loft_11])  # -> Breps, Closed; disabled

line_16 = Line(StartPoint=point_5, EndPoint=move_20.Geometry)  # disabled
line_17 = Line(StartPoint=move_20.Geometry, EndPoint=move_21.Geometry)  # disabled
line_18 = Line(StartPoint=move_21.Geometry, EndPoint=point_6)  # disabled
line_19 = Line(StartPoint=point_5, EndPoint=point_6)  # disabled
loft_12 = Loft(Curves=line_16, Options={Adjust=False, Closed=False, LoftEnds=0, LoftSimp=0, LoftType=0, Rebuild=10, Refit=0.01})  # disabled
loft_13 = Loft(Curves=line_17, Options={Adjust=False, Closed=False, LoftEnds=0, LoftSimp=0, LoftType=0, Rebuild=10, Refit=0.01})  # disabled
loft_14 = Loft(Curves=line_18, Options={Adjust=False, Closed=False, LoftEnds=0, LoftSimp=0, LoftType=0, Rebuild=10, Refit=0.01})  # disabled
loft_15 = Loft(Curves=line_19, Options={Adjust=False, Closed=False, LoftEnds=0, LoftSimp=0, LoftType=0, Rebuild=10, Refit=0.01})  # disabled
brep_join_5 = BrepJoin(Breps=[loft_12, loft_13, loft_14, loft_15])  # -> Breps, Closed; disabled

# ----
deconstruct_brep_3 = DeconstructBrep(Brep=loft_3)  # -> Faces, Edges, Vertices; disabled
unit_z_16 = UnitZ(Factor=Slider(4, range=0..10))
move_23 = Move(Geometry=construct_point_17, Motion=unit_z_16)  # -> Geometry, Transform
brep_wireframe = BrepWireframe(Brep=loft_3, Density=-1)  # disabled
delaunay_mesh_2 = DelaunayMesh(Points=divide_curve_6.Points, Plane=PlaneXY(0, 0, 0))  # disabled
list_length_11 = ListLength(List=divide_curve_6.Points)  # disabled
mesh_edges = MeshEdges(Mesh=construct_mesh_2)  # -> NakedEdges, InteriorEdges, NonManifoldEdges; disabled
multiplication_3 = Multiplication(A=number_slider_99, B=2)  # disabled
list_item_19 = ListItem(List=deconstruct_brep_3.Faces, Index=0, Wrap=True)  # -> Item, Item1, Item2, Item3; disabled
divide_curve_7 = DivideCurve(Curve=rectangle_6.Rectangle, Count=Slider(4, range=0..10), Kinks=False)  # -> Points, Tangents, Parameters
number_slider_100 = Slider(5, range=0..10)  # disabled
number_slider_101 = Slider(2, range=0..10)  # disabled
brep_3 = Brep(rectangle_6.Rectangle)
addition_2 = Addition(A=multiplication_3, B=1)  # disabled
surface_2 = Surface([list_item_19.Item, list_item_19.Item1, list_item_19.Item2, list_item_19.Item3])  # disabled
list_item_20 = ListItem(List=divide_curve_7.Points, Index=0, Wrap=True)  # -> Item, Item1, Item2
discontinuity_8 = Discontinuity(Curve=[mesh_edges.NakedEdges, mesh_edges.InteriorEdges], Level=1)  # -> Points, Parameters; disabled
radians_2 = Radians(Degrees=Slider(45, range=0..50))
rectangle_3pt = Rectangle3Pt(PointA=list_item_20.Item, PointB=list_item_20.Item1, PointC=list_item_20.Item2)  # -> Rectangle, Length
space_truss_structure_1 = SpaceTrussStructure1(Surface=surface_2, UDivisions=number_slider_100, VDivisions=number_slider_100, TrussDepth=number_slider_101)  # -> PrimaryLines, PrimaryLines_2, WebLines, StructureNodes; disabled
rotate_2 = Rotate(Geometry=rectangle_6.Rectangle, Angle=radians_2, Plane=PlaneXY(0, 0, 0))  # -> Geometry, Transform
brep_4 = Brep(rotate_2.Geometry)
solid_union = SolidUnion(Breps=[brep_4, brep_3])
brep_edges = BrepEdges(Brep=solid_union)  # -> Naked, Interior, NonManifold
discontinuity_9 = Discontinuity(Curve=rotate_2.Geometry, Level=1)  # -> Points, Parameters
curve_16 = Curve(brep_edges.Naked)
braced_grid_1_d_structure = BracedGrid1DStructure(Surface=surface_2, UDivisions=number_slider_100, VDivisions=number_slider_100)  # -> PrimaryLines, BraceLines, StructureNodes; disabled
curve_17 = Curve(space_truss_structure_1.PrimaryLines)  # disabled
curve_18 = Curve(space_truss_structure_1.PrimaryLines_2)  # disabled
curve_19 = Curve(space_truss_structure_1.WebLines)  # disabled
discontinuity_10 = Discontinuity(Curve=curve_16, Level=1)  # -> Points, Parameters
discontinuity_11 = Discontinuity(Curve=curve_17, Level=1)  # -> Points, Parameters; disabled
list_item_21 = ListItem(List=discontinuity_9.Points, Index=0, Wrap=True)
delaunay_mesh_3 = DelaunayMesh(Plane=PlaneXY(0, 0, 0))  # disabled
list_item_22 = ListItem(List=discontinuity_11.Points, Index=0, Wrap=True)  # -> Item, Item1, Item2; disabled
list_item_23 = ListItem(List=discontinuity_9.Points, Index=Slider(2, range=0..10), Wrap=True)
list_item_24 = ListItem(List=discontinuity_9.Points, Index=Slider(1, range=0..10), Wrap=True)
list_item_25 = ListItem(List=divide_curve_7.Points, Index=Slider(1, range=0..10), Wrap=True)
list_item_26 = ListItem(List=divide_curve_7.Points, Index=Slider(2, range=0..10), Wrap=True)
list_item_27 = ListItem(List=divide_curve_7.Points, Index=Slider(3, range=0..10), Wrap=True)
list_item_28 = ListItem(List=discontinuity_9.Points, Index=Slider(3, range=0..10), Wrap=True)
list_item_29 = ListItem(List=discontinuity_9.Points, Index=Slider(0, range=0..10), Wrap=True)
vector_2pt_3 = Vector2Pt(PointA=construct_point_15, PointB=list_item_21, Unitize=False)  # -> Vector, Length
circle = Circle(Plane=construct_point_15, Radius=vector_2pt_3.Length)
divide_curve_8 = DivideCurve(Curve=circle, Count=Slider(30, range=0..100), Kinks=False)  # -> Points, Tangents, Parameters
divide_curve_9 = DivideCurve(Curve=circle, Count=Slider(50, range=0..100), Kinks=False)  # -> Points, Tangents, Parameters
list_item_30 = ListItem(List=divide_curve_8.Points, Index=Slider(18, range=0..100), Wrap=True)
list_item_31 = ListItem(List=divide_curve_8.Points, Index=Slider(25, range=0..100), Wrap=True)
list_item_32 = ListItem(List=divide_curve_8.Points, Index=Slider(30, range=0..100), Wrap=True)
list_item_33 = ListItem(List=divide_curve_8.Points, Index=Slider(36, range=0..100), Wrap=True)
list_item_34 = ListItem(List=divide_curve_8.Points, Index=Slider(12, range=0..100), Wrap=True)
line_20 = Line(StartPoint=list_item_30, EndPoint=list_item_31)
line_21 = Line(StartPoint=list_item_31, EndPoint=list_item_32)
line_22 = Line(StartPoint=list_item_32, EndPoint=list_item_33)
line_23 = Line(StartPoint=list_item_33, EndPoint=list_item_34)
line_24 = Line(StartPoint=list_item_30, EndPoint=list_item_34)
join_curves_2 = JoinCurves(Curves=[line_20, line_21, line_22, line_23, line_24], Preserve=False)
divide_curve_10 = DivideCurve(Curve=join_curves_2, Count=Slider(1, range=0..100), Kinks=True)  # -> Points, Tangents, Parameters
delaunay_mesh_4 = DelaunayMesh(Points=flatten(divide_curve_10.Points), Plane=PlaneXY(0, 0, 0))
weaverbird_s_loop_subdivision = WeaverbirdsLoopSubdivision(MeshCurves=delaunay_mesh_4, Level=Slider(3, range=0..10), SmoothNakedEdges=0)
weaverbird_s_loop_subdivision_2 = WeaverbirdsLoopSubdivision(MeshCurves=weaverbird_s_loop_subdivision, Level=Slider(3, range=0..10), SmoothNakedEdges=0)
mesh_to_shell_karamba = MeshToShellKaramba(Mesh=weaverbird_s_loop_subdivision, LimitDistance_m=0.005)  # -> Element, Points, Info
closest_point = ClosestPoint(Point=list_item_23, Cloud=mesh_to_shell_karamba.Points)  # -> ClosestPoint, CPIndex, Distance
closest_point_2 = ClosestPoint(Point=list_item_24, Cloud=mesh_to_shell_karamba.Points)  # -> ClosestPoint, CPIndex, Distance
closest_point_3 = ClosestPoint(Point=list_item_25, Cloud=mesh_to_shell_karamba.Points)  # -> ClosestPoint, CPIndex, Distance
closest_point_4 = ClosestPoint(Point=list_item_26, Cloud=mesh_to_shell_karamba.Points)  # -> ClosestPoint, CPIndex, Distance
closest_point_5 = ClosestPoint(Point=list_item_27, Cloud=mesh_to_shell_karamba.Points)  # -> ClosestPoint, CPIndex, Distance
closest_point_6 = ClosestPoint(Point=list_item_28, Cloud=mesh_to_shell_karamba.Points)  # -> ClosestPoint, CPIndex, Distance
closest_point_7 = ClosestPoint(Point=list_item_29, Cloud=mesh_to_shell_karamba.Points)  # -> ClosestPoint, CPIndex, Distance
list_item_35 = ListItem(List=divide_curve_10.Points, Index=0, Wrap=True)
support_karamba = SupportKaramba(PosInd=list_item_34, menu=[buttons(on, on, on, on, on, on)])
support_karamba_2 = SupportKaramba(PosInd=list_item_32, menu=[buttons(on, on, on, on, on, on)])
support_karamba_3 = SupportKaramba(PosInd=list_item_33, menu=[buttons(on, on, on, on, on, on)])
support_karamba_4 = SupportKaramba(PosInd=list_item_30, menu=[buttons(on, on, on, on, on, on)])
support_karamba_5 = SupportKaramba(PosInd=list_item_31, menu=[buttons(on, on, on, on, on, on)])
support_karamba_6 = SupportKaramba(PosInd=closest_point.ClosestPoint, menu=[buttons(on, on, on, on, on, on)])
support_karamba_7 = SupportKaramba(PosInd=list_item_35, menu=[buttons(on, on, on, on, on, on)])
support_karamba_8 = SupportKaramba(PosInd=closest_point_2.ClosestPoint, menu=[buttons(on, on, on, on, on, on)])
support_karamba_9 = SupportKaramba(PosInd=closest_point_3.ClosestPoint, menu=[buttons(on, on, on, on, on, on)])
support_karamba_10 = SupportKaramba(PosInd=closest_point_4.ClosestPoint, menu=[buttons(on, on, on, on, on, on)])
support_karamba_11 = SupportKaramba(PosInd=closest_point_5.ClosestPoint, menu=[buttons(on, on, on, on, on, on)])
support_karamba_12 = SupportKaramba(PosInd=closest_point_6.ClosestPoint, menu=[buttons(on, on, on, on, on, on)])
support_karamba_13 = SupportKaramba(PosInd=closest_point_7.ClosestPoint, menu=[buttons(on, on, on, on, on, on)])
md_slider = MDSlider(
    slider_value=Point(0.4528004716, 0.5460979183, 0.5),
    SliderMode=0,
    x_domain=Domain(0, 1),
    y_domain=Domain(0, 1),
    z_domain=Domain(0, 1))
construct_point_18 = ConstructPoint(XCoordinate=0, YCoordinate=0, ZCoordinate=0)
unit_z_17 = UnitZ(Factor=Slider(0.41788, range=0..10))
brep_5 = Brep(join_curves_2)
evaluate_surface = EvaluateSurface(Surface=reparameterize(brep_5), Point=md_slider)  # -> Point, Normal, Frame
closest_point_8 = ClosestPoint(Point=evaluate_surface.Point, Cloud=mesh_to_shell_karamba.Points)  # -> ClosestPoint, CPIndex, Distance
assemble_model_karamba_2 = AssembleModelKaramba(LimitDistance_m=0.005)  # -> Model, Info, Mass_kg, CenterOfGravity
loads_karamba = LoadsKaramba(ForceVector=unit_z_17, Local=False, PosInd=closest_point_8.ClosestPoint, LCase=0, mode="Point")
read_material_table_from_file_karamba = ReadMaterialTableFromFileKaramba()
assemble_model_karamba_3 = AssembleModelKaramba(
    Points=mesh_to_shell_karamba.Points,
    Elem=mesh_to_shell_karamba.Element,
    Support=[support_karamba_5, support_karamba_4, support_karamba_2, support_karamba_3, support_karamba],
    Load=loads_karamba,
    LimitDistance_m=0.005)  # -> Model, Info, Mass_kg, CenterOfGravity
panel_13 = Panel(read_material_table_from_file_karamba)
analyzethi_karamba = AnalyzeThIKaramba(Model=assemble_model_karamba_3.Model)  # -> CalculatedModel, MaximumDisplacement_m, ResultingForceOfGravity_kN, ElasticEnergy_kNm
model_view_karamba = ModelViewKaramba(Model=analyzethi_karamba.CalculatedModel, LoadCaseFactorsForLinearSuperposition=1, IndexOfVisibleLoadcase=-1)  # -> Model, DeformedMesh, DeformedAxes, DeformedModel
beso_for_shells_karamba = BESOForShellsKaramba(
    Model=model_view_karamba.Model,
    LCases=0,
    TargetMassRatio=Slider(0.672, range=0..1),
    MaxIter=10,
    ER=-1,
    ARmax=0.05,
    Nhist=3,
    Conv=Slider(0.5, range=0..1),
    Rmin=-1,
    Rexp=1,
    KillThick=0.1)  # -> BSEOModel, ModelHistory, CHistory, VHistory, Info
construct_domain_9 = ConstructDomain(DomainStart=0, DomainEnd=1)
range_3 = Range(Domain=construct_domain_9, Steps=Slider(100, range=0..100))
gradient = Gradient(LowerLimit=0, UpperLimit=1, Parameter=range_3, stops=[0: RGB(255, 255, 255), 1: RGB(0, 0, 0)])
model_view_karamba_2 = ModelViewKaramba(
    Model=beso_for_shells_karamba.BSEOModel,
    LoadCaseFactorsForLinearSuperposition=1,
    IndexOfVisibleLoadcase=-1,
    ListOfColorsForColoringPlots=gradient)  # -> Model, DeformedMesh, DeformedAxes, DeformedModel
shell_view_karamba = ShellViewKaramba(Model=model_view_karamba.Model, IndexOfLayer=0)  # -> Model, MeshesOfRenderedShells, LegendColors, LegendTags
mesh_4 = Mesh(shell_view_karamba.MeshesOfRenderedShells)
deconstruct_mesh_3 = DeconstructMesh(Mesh=mesh_4)  # -> flatten(Vertices), Faces, Colours, Normals
shell_view_karamba_2 = ShellViewKaramba(Model=model_view_karamba_2.Model, IndexOfLayer=0)  # -> Model, MeshesOfRenderedShells, LegendColors, LegendTags
line_results_on_shells_karamba = LineResultsOnShellsKaramba(
    AnalyzedModel=model_view_karamba.Model,
    Layer=0,
    GlobalForceDirections=unit_z_17,
    GlobalForceDirectionPosition=deconstruct_mesh_3.Vertices,
    ListOfSourcesOfForceFlowLinesLinesPoints=deconstruct_mesh_3.Vertices,
    SegmentLength_m=0.5,
    DA_deg=5,
    Theta_deg=0,
    mode="ForceFlow")  # -> AnalyzedModel, Lines
curve_20 = Curve(line_results_on_shells_karamba.Lines)

# ==== cluster SpringsFromMesh: Turns all edges of a mesh into springs
M = ClusterInput()
medges = MeshEdges(Mesh=M)  # -> NakedEdges, InteriorEdges, NonManifoldEdges
crv = Curve([medges.NakedEdges, medges.InteriorEdges])
B = ClusterInput()
len = Length(Curve=crv)
multiplication = Multiplication(A=len, B=B)
stiffness = ClusterInput()
springs = SpringsFromLine(Connection=crv, Stiffness=stiffness, Damping=10, RestLength=multiplication, UpperCutoff=0, LowerCutoff=0, Plasticity=0)
S = ClusterOutput(springs)
