# Grasshopper definition RoofKaramba.gh (Grasshopper 0.9.76)
# plug-ins: Karamba

number_slider = Slider(4.224944, range=0..10)
construct_domain = ConstructDomain(DomainStart=expr("-x", number_slider), DomainEnd=number_slider)
construct_point = ConstructPoint(XCoordinate=0, YCoordinate=0, ZCoordinate=0)
construct_domain_2 = ConstructDomain(DomainStart=Slider(0, range=0..100), DomainEnd=Slider(1, range=0..1))
rectangle = Rectangle(Plane=construct_point, XSize=construct_domain, YSize=construct_domain, Radius=0)  # -> Rectangle, Length
range = Range(Domain=construct_domain_2, Steps=Slider(9, range=0..10))
explode = Explode(Curve=rectangle.Rectangle, Recursive=True)  # -> Segments, Vertices
list_item = ListItem(List=explode.Segments, Index=0, Wrap=True)  # -> Item, Item1, Item2
circle_tantantan = CircleTanTanTan(CurveA=list_item.Item, CurveB=list_item.Item1, CurveC=list_item.Item2, Point=construct_point)
graph_mapper = GraphMapper(range, x0=0, x1=1, y0=0, y1=1, container_name="Gaussian", factor=0.7753623128, mean=0.4710144997, sdev=0.3043478131)
construct_point_2 = ConstructPoint(XCoordinate=0, YCoordinate=0, ZCoordinate=0)
list_item_2 = ListItem(List=explode.Vertices, Index=0, Wrap=True)
unit_z = UnitZ(Factor=expr("x*10", graph_mapper))
c_script = CSharpScript(x=Slider(10, range=0..10), y=Slider(10, range=0..10))  # -> out, A; inputs x: Int32, y: Int32
# ---------- c_script: C# ----------
    var points = new DataTree<Point3d>();
    
    for( int i = 0; i < x; ++i )
      for( int j = 0; j < y; ++j )
      {
      
        var path = new GH_Path( i );
        points.Add( new Point3d( i, j, 0 ), path );
      
      }
    
    A = points;
# ---------- end c_script ----------
unit_z_2 = UnitZ(Factor=Slider(4, range=0..10))
move = Move(Geometry=construct_point_2, Motion=unit_z_2)  # -> Geometry, Transform
list_item_3 = ListItem(List=c_script.A, Index=Slider(55, range=0..100), Wrap=True)
move_2 = Move(Geometry=flatten(list_item_3), Motion=unit_z)  # -> Geometry, Transform
flip_matrix = FlipMatrix(Data=c_script.A)
vector_2pt = Vector2Pt(PointA=flatten(list_item_3), PointB=move_2.Geometry, Unitize=False)  # -> Vector, Length
brep = Brep(rectangle.Rectangle)
polyline = PolyLine(Vertices=flip_matrix, Closed=False)
polyline_2 = PolyLine(Vertices=c_script.A, Closed=False)
vector_display = VectorDisplay(Anchor=flatten(list_item_3), Vector=vector_2pt.Vector)
radians = Radians(Degrees=Slider(45, range=0..50))
end_points = EndPoints(Curve=polyline_2)  # -> Start, End
rotate = Rotate(Geometry=rectangle.Rectangle, Angle=radians, Plane=PlaneXY(0, 0, 0))  # -> Geometry, Transform
brep_2 = Brep(rotate.Geometry)
solid_union = SolidUnion(Breps=[brep_2, brep])
brep_edges = BrepEdges(Brep=solid_union)  # -> Naked, Interior, NonManifold
read_cross_section_table_from_file_karam = ReadCrossSectionTableFromFileKaramba()  # -> CrossSection, Info
curve = Curve(brep_edges.Naked)
number_slider_2 = Slider(8.2, range=0..10)
discontinuity = Discontinuity(Curve=curve, Level=1)  # -> Points, Parameters
panel = Panel(read_cross_section_table_from_file_karam.CrossSection)
point = Point(construct_point)
panel_2 = Panel("0")
unit_z_3 = UnitZ(Factor=vector_2pt.Vector)
cross_section_selector_karamba = CrossSectionSelectorKaramba(CrossSections=read_cross_section_table_from_file_karam.CrossSection, NameOrListIndexOfCrossSection="IPE140")  # -> CrossSection, Info
vector_2pt_2 = Vector2Pt(PointA=construct_point_2, PointB=list_item_2, Unitize=False)  # -> Vector, Length
support_karamba = SupportKaramba(PosInd=[end_points.End, end_points.Start], menu=[buttons(on, on, on, on, on, on)])
line_to_beam_karamba = LineToBeamKaramba(Line=polyline_2, Identifier="beamOne", New=True, Remove=True, LimitDistance_m=0.005)  # -> Element, Points, Info
loads_karamba = LoadsKaramba(Vector=unit_z_3, LCase=0, mode="Gravity")  # -> graft(Load)
circle = Circle(Plane=construct_point, Radius=vector_2pt_2.Length)
divide_curve = DivideCurve(Curve=circle, Count=Slider(30, range=0..100), Kinks=False)  # -> Points, Tangents, Parameters
list_item_4 = ListItem(List=divide_curve.Points, Index=Slider(18, range=0..100), Wrap=True)
list_item_5 = ListItem(List=divide_curve.Points, Index=Slider(24, range=0..100), Wrap=True)
list_item_6 = ListItem(List=divide_curve.Points, Index=Slider(30, range=0..100), Wrap=True)
list_item_7 = ListItem(List=divide_curve.Points, Index=Slider(36, range=0..100), Wrap=True)
list_item_8 = ListItem(List=divide_curve.Points, Index=Slider(12, range=0..100), Wrap=True)
line = Line(StartPoint=list_item_4, EndPoint=list_item_5)
line_2 = Line(StartPoint=list_item_5, EndPoint=list_item_6)
line_3 = Line(StartPoint=list_item_6, EndPoint=list_item_7)
line_4 = Line(StartPoint=list_item_7, EndPoint=list_item_8)
line_5 = Line(StartPoint=list_item_4, EndPoint=list_item_8)
line_6 = Line(StartPoint=list_item_4, EndPoint=point)
line_7 = Line(StartPoint=list_item_5, EndPoint=point)
line_8 = Line(StartPoint=list_item_6, EndPoint=point)
line_9 = Line(StartPoint=list_item_7, EndPoint=point)
line_10 = Line(StartPoint=list_item_8, EndPoint=point)
join_curves = JoinCurves(Curves=[line, line_2, line_3, line_4, line_5], Preserve=False)
brep_3 = Brep(join_curves)
assemble_model_karamba = AssembleModelKaramba(
    Points=line_to_beam_karamba.Points,
    Elem=line_to_beam_karamba.Element,
    Support=support_karamba,
    Load=loads_karamba,
    CrossSection=cross_section_selector_karamba.CrossSection,
    LimitDistance_m=0.005)  # -> Model, Info, Mass_kg, CenterOfGravity
read_cross_section_table_from_file_karam_2 = ReadCrossSectionTableFromFileKaramba()  # -> CrossSection, Info
area = Area(Geometry=brep_3)  # -> Area, Centroid
panel_3 = Panel(area.Area)
panel_4 = Panel(read_cross_section_table_from_file_karam_2.CrossSection)
analyzethi_karamba = AnalyzeThIKaramba(Model=assemble_model_karamba.Model)  # -> CalculatedModel, MaximumDisplacement_m, ResultingForceOfGravity_kN, ElasticEnergy_kNm
unit_z_4 = UnitZ(Factor=expr("x*50", Slider(0.64, range=0..20)))
cross_section_selector_karamba_2 = CrossSectionSelectorKaramba(CrossSections=read_cross_section_table_from_file_karam_2.CrossSection, NameOrListIndexOfCrossSection="IPE180")  # -> CrossSection, Info
support_karamba_2 = SupportKaramba(PosInd=[list_item_8, list_item_4, list_item_5, list_item_6, list_item_7], menu=[buttons(on, on, on, on, on, on)])
line_to_beam_karamba_2 = LineToBeamKaramba(Line=[line_6, line_7, line_8, line_9, line_10], Identifier="beamOne", New=True, Remove=True, LimitDistance_m=0.005)  # -> Element, Points, Info
loads_karamba_2 = LoadsKaramba(Vector=unit_z_4, LCase=0, mode="Gravity")
model_view_karamba = ModelViewKaramba(Model=analyzethi_karamba.CalculatedModel, LoadCaseFactorsForLinearSuperposition=1, IndexOfVisibleLoadcase=-1)  # -> Model, DeformedMesh, DeformedAxes, DeformedModel
assemble_model_karamba_2 = AssembleModelKaramba(
    Points=line_to_beam_karamba_2.Points,
    Elem=line_to_beam_karamba_2.Element,
    Support=support_karamba_2,
    Load=loads_karamba_2,
    CrossSection=cross_section_selector_karamba_2.CrossSection,
    LimitDistance_m=0.005)  # -> Model, Info, Mass_kg, CenterOfGravity
beam_view_karamba = BeamViewKaramba(Model=model_view_karamba.Model)  # -> Model, MeshesOfRenderedBeams, DeformedBeamAxes, LegendColors, LegendTags
number_slider_3 = Slider(5, range=0..10)
analyzethi_karamba_2 = AnalyzeThIKaramba(Model=assemble_model_karamba_2.Model)  # -> CalculatedModel, MaximumDisplacement_m, ResultingForceOfGravity_kN, ElasticEnergy_kNm
model_view_karamba_2 = ModelViewKaramba(Model=analyzethi_karamba_2.CalculatedModel, LoadCaseFactorsForLinearSuperposition=1, IndexOfVisibleLoadcase=-1)  # -> Model, DeformedMesh, DeformedAxes, DeformedModel
list_item_9 = ListItem(List=model_view_karamba_2.DeformedAxes, Index=0, Wrap=True)  # -> Item, Item1, Item2, Item3, Item4
list_item_10 = ListItem(List=model_view_karamba_2.DeformedAxes, Index=0, Wrap=True)  # -> Item, Item1
list_item_11 = ListItem(List=model_view_karamba_2.DeformedAxes, Index=0, Wrap=True)  # -> Item, Item1, Item2, Item3, Item4
list_item_12 = ListItem(List=model_view_karamba_2.DeformedAxes, Index=0, Wrap=True)  # -> Item, Item1, Item2, Item3
list_item_13 = ListItem(List=model_view_karamba_2.DeformedAxes, Index=0, Wrap=True)  # -> Item, Item1, Item2, Item3, Item4
divide_curve_2 = DivideCurve(Curve=list_item_9.Item4, Count=number_slider_3, Kinks=False)  # -> Points, Tangents, Parameters
divide_curve_3 = DivideCurve(Curve=list_item_9.Item, Count=number_slider_3, Kinks=False)  # -> Points, Tangents, Parameters
divide_curve_4 = DivideCurve(Curve=list_item_10.Item1, Count=number_slider_3, Kinks=False)  # -> Points, Tangents, Parameters
divide_curve_5 = DivideCurve(Curve=list_item_11.Item3, Count=number_slider_3, Kinks=False)  # -> Points, Tangents, Parameters
divide_curve_6 = DivideCurve(Curve=list_item_12.Item2, Count=number_slider_3, Kinks=False)  # -> Points, Tangents, Parameters
divide_curve_7 = DivideCurve(Curve=list_item_13.Item4, Count=number_slider_3, Kinks=False)  # -> Points, Tangents, Parameters
divide_curve_8 = DivideCurve(Curve=list_item_10.Item, Count=number_slider_3, Kinks=False)  # -> Points, Tangents, Parameters
divide_curve_9 = DivideCurve(Curve=list_item_11.Item2, Count=number_slider_3, Kinks=False)  # -> Points, Tangents, Parameters
divide_curve_10 = DivideCurve(Curve=list_item_12.Item1, Count=number_slider_3, Kinks=False)  # -> Points, Tangents, Parameters
divide_curve_11 = DivideCurve(Curve=list_item_13.Item3, Count=number_slider_3, Kinks=False)  # -> Points, Tangents, Parameters
beam_view_karamba_2 = BeamViewKaramba(Model=model_view_karamba_2.Model)  # -> Model, MeshesOfRenderedBeams, DeformedBeamAxes, LegendColors, LegendTags
line_11 = Line(StartPoint=divide_curve_3.Points, EndPoint=divide_curve_2.Points)  # -> graft(Line)
line_12 = Line(StartPoint=divide_curve_8.Points, EndPoint=divide_curve_4.Points)  # -> graft(Line)
line_13 = Line(StartPoint=divide_curve_9.Points, EndPoint=divide_curve_5.Points)  # -> graft(Line)
line_14 = Line(StartPoint=divide_curve_10.Points, EndPoint=divide_curve_6.Points)  # -> graft(Line)
line_15 = Line(StartPoint=divide_curve_11.Points, EndPoint=divide_curve_7.Points)  # -> graft(Line)
curve_2 = Curve(model_view_karamba_2.DeformedAxes)
list_item_14 = ListItem(List=curve_2, Index=0, Wrap=True)  # -> Item, Item1
cull_index = CullIndex(List=divide_curve_3.Points, Indices=Slider(5, range=0..100), Wrap=True)
cull_index_2 = CullIndex(List=divide_curve_2.Points, Indices=Slider(5, range=0..100), Wrap=True)
cull_index_3 = CullIndex(List=divide_curve_8.Points, Indices=Slider(5, range=0..100), Wrap=True)
cull_index_4 = CullIndex(List=divide_curve_4.Points, Indices=Slider(5, range=0..100), Wrap=True)
cull_index_5 = CullIndex(List=divide_curve_9.Points, Indices=Slider(5, range=0..100), Wrap=True)
cull_index_6 = CullIndex(List=divide_curve_5.Points, Indices=Slider(5, range=0..100), Wrap=True)
cull_index_7 = CullIndex(List=divide_curve_10.Points, Indices=Slider(5, range=0..100), Wrap=True)
cull_index_8 = CullIndex(List=divide_curve_6.Points, Indices=Slider(5, range=0..100), Wrap=True)
cull_index_9 = CullIndex(List=divide_curve_11.Points, Indices=Slider(5, range=0..100), Wrap=True)
cull_index_10 = CullIndex(List=divide_curve_7.Points, Indices=Slider(5, range=0..100), Wrap=True)
curve_curve = CurveCurve(CurveA=list_item_14.Item, CurveB=list_item_14.Item1)  # -> Points, ParamsA, ParamsB
end_points_2 = EndPoints(Curve=list_item_14.Item)  # -> Start, End
end_points_3 = EndPoints(Curve=list_item_14.Item1)  # -> Start, End
point_2 = Point(graft(cull_index))
point_3 = Point(graft(cull_index_2))
point_4 = Point(graft(cull_index_3))
point_5 = Point(graft(cull_index_4))
point_6 = Point(graft(cull_index_5))
point_7 = Point(graft(cull_index_6))
point_8 = Point(graft(cull_index_7))
point_9 = Point(graft(cull_index_8))
point_10 = Point(graft(cull_index_9))
point_11 = Point(graft(cull_index_10))
read_cross_section_table_from_file_karam_3 = ReadCrossSectionTableFromFileKaramba()  # -> CrossSection, Info
panel_5 = Panel(read_cross_section_table_from_file_karam_3.CrossSection)
merge = Merge(Data1=point_4, Data2=point_5, Data3=point_9, Data4=point_7, Data5=point_11)
cross_section_selector_karamba_3 = CrossSectionSelectorKaramba(CrossSections=read_cross_section_table_from_file_karam_3.CrossSection, NameOrListIndexOfCrossSection="IPE80")  # -> CrossSection, Info
line_to_beam_karamba_3 = LineToBeamKaramba(Line=[line_12, line_14, line_13, line_15, line_11], Identifier="beamOne", New=True, Remove=True, LimitDistance_m=0.005)  # -> Element, Points, Info
support_karamba_3 = SupportKaramba(PosInd=merge, menu=[buttons(on, on, on, on, on, on)])
assemble_model_karamba_3 = AssembleModelKaramba(
    Points=line_to_beam_karamba_3.Points,
    Elem=line_to_beam_karamba_3.Element,
    Support=support_karamba_3,
    Load=loads_karamba_2,
    CrossSection=cross_section_selector_karamba_3.CrossSection,
    LimitDistance_m=0.005)  # -> Model, Info, Mass_kg, CenterOfGravity
analyzethi_karamba_3 = AnalyzeThIKaramba(Model=assemble_model_karamba_3.Model)  # -> CalculatedModel, MaximumDisplacement_m, ResultingForceOfGravity_kN, ElasticEnergy_kNm
model_view_karamba_3 = ModelViewKaramba(Model=analyzethi_karamba_3.CalculatedModel, LoadCaseFactorsForLinearSuperposition=1, IndexOfVisibleLoadcase=-1)  # -> Model, DeformedMesh, DeformedAxes, DeformedModel
curve_3 = Curve(model_view_karamba_3.DeformedAxes)
flatten_tree = FlattenTree(Tree=curve_3, Path="{0}")
list_item_15 = ListItem(List=flatten_tree, Index=Slider(9, range=0..10), Wrap=True)
divide_curve_12 = DivideCurve(Curve=list_item_15, Count=10, Kinks=False)  # -> Points, Tangents, Parameters
deconstruct = Deconstruct(Point=divide_curve_12.Points)  # -> XComponent, YComponent, expr("x*10", ZComponent)
addition = Addition(A=deconstruct.YComponent, B=deconstruct.ZComponent)
point_list = PointList(Points=divide_curve_12.Points)
sort_list = SortList(Keys=addition, ValuesA=divide_curve_12.Points)  # -> Keys, ValuesA
beam_view_karamba_3 = BeamViewKaramba(Model=model_view_karamba_3.Model)  # -> Model, MeshesOfRenderedBeams, DeformedBeamAxes, LegendColors, LegendTags
reverse_list = ReverseList(List=sort_list.ValuesA)
point_list_2 = PointList(Points=sort_list.ValuesA)
list_item_16 = ListItem(List=reverse_list, Index=0, Wrap=True)
divide_curve_13 = DivideCurve(Curve=curve_3, Count=10, Kinks=False)  # -> simplify(Points), Tangents, Parameters
tree_branch = TreeBranch(Tree=divide_curve_13.Points, Path="{0;1}", MaintainPaths=True)
project = Project(Curve=list_item_15, Brep=brep_3, Direction=Vector(0, 0, 1))
relative_item = RelativeItem(Tree=divide_curve_13.Points, Offset="{+1;0}", WrapPaths=False, WrapItems=False)  # -> ItemA, ItemB
line_16 = Line(StartPoint=construct_point, EndPoint=curve_curve.Points)
line_17 = Line(StartPoint=end_points_2.Start, EndPoint=end_points_3.Start)
divide_curve_14 = DivideCurve(Curve=project, Count=10, Kinks=False)  # -> Points, Tangents, Parameters
closest_point = ClosestPoint(Point=list_item_16, Cloud=divide_curve_14.Points)  # -> ClosestPoint, CPIndex, Distance
line_18 = Line(StartPoint=list_item_16, EndPoint=closest_point.ClosestPoint)
line_19 = Line(StartPoint=relative_item.ItemA, EndPoint=relative_item.ItemB)
loft = Loft(Curves=line_19, Options={Adjust=False, Closed=False, LoftEnds=0, LoftSimp=0, LoftType=0, Rebuild=10, Refit=0.01})
line_dimension = LineDimension(Line=line_18, Text="{0:0.00}", Size=1)
line_dimension_2 = LineDimension(Line=line_16, Text="{0:0.00}", Size=1)
line_dimension_3 = LineDimension(Line=line_17, Text="{0:0.00}", Size=1)
mesh = Mesh([beam_view_karamba_3.MeshesOfRenderedBeams, beam_view_karamba_2.MeshesOfRenderedBeams])
