# Grasshopper definition TrabajoPaula.gh (Grasshopper 0.9.76)
# plug-ins: Python Interpreter

rotz = Slider(0, range=0..1)
ladybug = Ladybug_Ladybug()  # -> Vviiiiiiiiiizzz; disabled; plug-in component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
panel = Panel("-3.5 To 3.5")  # disabled
xy = XYPlane(Origin=Point(0, 0, 0))
xy_2 = XYPlane(Origin=Point(0, 0, 0))  # disabled
c_script = CSharpScript(
    ScaleX=Slider(1, range=0..1),
    ScaleY=Slider(1, range=0..1),
    ScaleZ=Slider(1, range=0..1),
    RotX=Slider(1, range=0..1),
    RotY=Slider(0, range=0..1),
    RotZ=rotz)  # -> out, A, B; inputs ScaleX: Double, ScaleY: Double, ScaleZ: Double, RotX: Double, RotY: Double, RotZ: Double
# ---------- c_script: C# ----------
    var point = new Point3d(0, 0, 0);

    var sph = new Rhino.Geometry.Sphere(point, 4).ToNurbsSurface();
    var sca = Transform.Scale(Plane.WorldXY, ScaleX, ScaleY, ScaleZ);
    sph.Transform(sca);

    RotX = RotX * ( Math.PI );
    var rotX = Transform.Rotation(Math.Sin(RotX), Math.Cos(RotX), Vector3d.ZAxis, point);
    sph.Transform(rotX);
    RotY = RotY * ( Math.PI );
    var rotY = Transform.Rotation(Math.Sin(RotY), Math.Cos(RotY), Vector3d.XAxis, point);
    //sph.Transform(rotY);
    RotZ = RotZ * ( Math.PI );
    var rotZ = Transform.Rotation(Math.Sin(RotZ), Math.Cos(RotZ), Vector3d.YAxis, point);
    //sph.Transform(rotZ);

    var sphBrep = sph.ToBrep();
    var bbox = sphBrep.GetBoundingBox(true).ToBrep();
    var bboxContours = Brep.CreateContourCurves(bbox, Plane.WorldXY);

    var extrude = Extrusion.Create(bboxContours[0], -4, true).ToBrep();

    Brep[] toDifference = new Brep[2];
    toDifference[0] = sphBrep;
    toDifference[1] = extrude;
    var boolDifference = Brep.CreateBooleanDifference(toDifference[0], toDifference[1], 0.001);

    A = boolDifference[0];

    B = bboxContours;
# ---------- end c_script ----------
number_slider = Slider(4, range=0..10)  # disabled
toggle = BooleanToggle(True)  # disabled
rectangle = Rectangle(Plane=xy, XSize="-3.5 To 3.5", YSize="-3.5 To 3.5", Radius=0)  # -> Rectangle, Length
rectangle_2 = Rectangle(Plane=xy_2, XSize=panel, YSize=panel, Radius=0)  # -> Rectangle, Length; disabled
sph = Sphere(Base=xy_2, Radius=number_slider)  # disabled
open_weather_file = Ladybug_OpenEPWWeatherFile(open=toggle)  # -> epwFile; disabled; plug-in component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
debrep = DeconstructBrep(Brep=rectangle.Rectangle)  # -> Faces, Edges, Vertices
debrep_2 = DeconstructBrep(Brep=rectangle_2.Rectangle)  # -> Faces, Edges, Vertices; disabled
item = ListItem(List=debrep.Edges, Index=0, Wrap=True)  # -> Item, Item1, Item2
item_2 = ListItem(List=debrep_2.Edges, Index=0, Wrap=True)  # -> Item, Item1, Item2; disabled
toggle_2 = BooleanToggle(True)
toggle_3 = BooleanToggle(True)  # disabled
number_slider_2 = Slider(4, range=0..10)  # disabled
circlettt = CircleTanTanTan(CurveA=item.Item, CurveB=item.Item1, CurveC=item.Item2, Point=xy)
circlettt_2 = CircleTanTanTan(CurveA=item_2.Item, CurveB=item_2.Item1, CurveC=item_2.Item2, Point=xy_2)  # disabled
gencumulativeskymtx = Ladybug_GenCumulativeSkyMtx(epwFile=open_weather_file, skyDensity=0, useOldRes=True, runIt=toggle_3)  # -> readMe, cumulativeSkyMtx; disabled; plug-in component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
Z = UnitZ(Factor=number_slider_2)  # disabled
number_slider_3 = Slider(1, range=0..1)  # disabled
number_slider_4 = Slider(1, range=0..1)  # disabled
number_slider_5 = Slider(1, range=0..1)  # disabled
number_slider_6 = Slider(12, range=0..100)  # disabled
number_slider_7 = Slider(30, range=0..100)  # disabled
number_slider_8 = Slider(24, range=0..100)  # disabled
divide = DivideCurve(Curve=circlettt, Count=10, Kinks=False)  # -> Points, Tangents, Parameters
extr = Extrude(Base=circlettt_2, Direction=Z)  # disabled
split = SplitList(List=divide.Points, Index=Slider(7, range=0..10))  # -> ListA, ListB
analysisperiod = Ladybug_AnalysisPeriod(
    fromMonth=number_slider_3,
    fromDay=number_slider_4,
    fromHour=number_slider_5,
    toMonth=number_slider_6,
    toDay=number_slider_7,
    toHour=number_slider_8)  # -> readMe, analysisPeriod; disabled; plug-in component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
number_slider_9 = Slider(4, range=0..4)  # disabled
cap = CapHoles(Brep=extr)  # disabled
srf = Surface(rectangle_2.Rectangle)  # disabled
ln = Line(StartPoint=split.ListA, EndPoint=split.ListB)
selectskymtx = Ladybug_selectSkyMtx(
    cumulativeSkyMtx=gencumulativeskymtx.cumulativeSkyMtx,
    analysisPeriod=analysisperiod.analysisPeriod,
    removeDiffuse=False,
    removeDirect=False)  # -> readMe, selectedSkyMtx; disabled; plug-in component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
number_slider_10 = Slider(0.3, range=0..1)  # disabled
toggle_4 = BooleanToggle(False)  # disabled
Z_2 = UnitZ(Factor=number_slider_9)  # disabled
toggle_5 = BooleanToggle(True)  # disabled
importlocation = Ladybug_ImportLocation(epwFile=open_weather_file)  # -> location; disabled; plug-in component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
split_2 = SplitList(List=ln, Index=Slider(2, range=0..10))  # -> ListA, ListB
ccx = CurveCurve(CurveA=split_2.ListA, CurveB=split_2.ListB)  # -> Points, ParamsA, ParamsB
toggle_6 = BooleanToggle(True)  # disabled
extr_2 = Extrude(Base=srf, Direction=Z_2)  # disabled
toggle_7 = BooleanToggle(True)  # disabled
sdiff = SolidDifference(BrepsA=extr_2, BrepsB=cap)  # disabled
radiationanalysis = Ladybug_RadiationAnalysis(
    geometry=flatten(srf),
    context=flatten(sdiff),
    gridSize=number_slider_10,
    disFromBase=number_slider_10,
    selectedSkyMtx=flatten(selectskymtx.selectedSkyMtx),
    runIt=toggle_4)  # -> readMe, contextMesh, analysisMesh, testPts, testVec, port, radiationResult, radiationMesh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; disabled; plug-in component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
radiationrose = Ladybug_RadiationRose(selectedSkyMtx=selectskymtx.selectedSkyMtx, arrowHeadScale=1, runIt=toggle_5)  # -> readMe, radiationArrowsMesh, radRoseBaseCrvs, legend, legendBasePts, radRoseEndPts, radRoseValues; disabled; plug-in component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
radiationanalysis_2 = Ladybug_RadiationAnalysis(
    geometry=flatten(sph),
    gridSize=number_slider_10,
    disFromBase=number_slider_10,
    selectedSkyMtx=flatten(selectskymtx.selectedSkyMtx),
    parallel=toggle_7,
    runIt=toggle_7)  # -> readMe, contextMesh, analysisMesh, testPts, testVec, port, radiationResult, radiationMesh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; disabled; plug-in component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
sunpath = Ladybug_SunPath(
    location=importlocation,
    hour=12,
    day=21,
    month=12,
    timeStep=1,
    analysisPeriod=analysisperiod.analysisPeriod,
    dailyOrAnnualSunPath=True)  # -> readMe, sunVectors, sunAltitudes, sunAzimuths, port, sunSpheresMesh, sunPathCrvs, compassCrvs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; disabled; plug-in component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
mesh = Mesh(radiationanalysis.radiationMesh)  # disabled
panel_2 = Panel(radiationanalysis.radiationResult)  # disabled
demesh = DeconstructMesh(Mesh=mesh)  # -> Vertices, Faces, Colours, Normals; disabled
number_slider_11 = Slider(1, range=0..5)  # disabled
number_slider_12 = Slider(0.4453, range=0..1)  # disabled
lng = ListLength(List=demesh.Vertices)  # disabled
multiplication = Multiplication(A=demesh.Colours, B=number_slider_11)  # disabled
pt = Point(demesh.Vertices)  # disabled
sqrt = SquareRoot(Value=lng)  # disabled
panel_3 = Panel(multiplication)  # disabled
panel_4 = Panel(sqrt)  # disabled
addition = Addition(A=multiplication, B=number_slider_12)  # disabled
pdecon = Deconstruct(Point=pt)  # -> XComponent, YComponent, ZComponent; disabled
pt_2 = ConstructPoint(XCoordinate=pdecon.XComponent, YCoordinate=pdecon.YComponent, ZCoordinate=multiplication)  # disabled
pline = PolyLine(Vertices=pt_2, Closed=False)  # disabled
conmesh = ConstructMesh(Vertices=pt_2, Faces=demesh.Faces)  # disabled
del = DelaunayMesh(Points=pt_2, Plane=PlaneXY(0, 0, 0))  # disabled
